vi "Check_File_Content_iCombi_Pro.gviweb"   [G Web Development Software 22.3.0]
inputs:
  "Inhalt Haccp": string
  "file type xml": string
  "file type_txt": string
  "Error input": error
outputs:
  "Error Output": error
  "HACCP File Content": string
  "i Combi Pro ?": bool
uses:
  NI::G Core::Strings::Search and Replace Pattern.gvi
  NI::G Core::Strings::Trim Whitespace.gvi
diagram:
  case ($"file type xml") {
    frame ".xml" {
      Match Pattern(regular expression="1.2>", string=$"Inhalt Haccp") -> (after substring=w4)
      Match Pattern(regular expression="</_1.2", string=w4) -> (before substring=w5)
      call "Search and Replace Pattern.gvi"(string=w5, pattern=">>") -> (result string=w6)
      call "Trim Whitespace.gvi"(string=w6) -> (trimmed string=w7)
      case (w7) {
        frame "False", Default {
          w8 = "The device type is incorrect, select a correct iCombi-pro HACCP file!"
          One Button Dialog(button name ("OK")="OK", message=w8)
          w9 = "❌"  # String {0}
          w1 = w9
          w3 = $"Error input"
          w2 = FALSE
        }
        frame "623", "E101", "E102", "E201", "E202", "E523", "E61", "E61T", "E62", "E623", "G101", "G102", "G201", "G202", "G61", "G62" {
          w1 = "✅"
          w3 = $"Error input"
          w2 = TRUE
        }
      }
    }
    frame "False", Default {
      Match Pattern(regular expression=".txt", string=$"file type_txt") -> (match substring=w10)
      case (w10) {
        frame "False", Default {
          w3 = no error
          w1 = ""
          w2 = FALSE
        }
        frame ".txt" {
          Match Pattern(regular expression="Dev-Typ", string=$"Inhalt Haccp") -> (after substring=w11)
          Match Pattern(regular expression="<<", string=w11) -> (before substring=w12)
          call "Search and Replace Pattern.gvi"(string=w12, pattern=">>") -> (result string=w13)
          call "Trim Whitespace.gvi"(string=w13) -> (trimmed string=w14)
          case (w14) {
            frame "False", Default {
              w15 = "The device type is incorrect, select a correct iCombi-pro HACCP file!"
              One Button Dialog(button name ("OK")="OK", message=w15)
              w16 = "❌"  # String {0}
              w1 = w16
              w3 = $"Error input"
              w2 = FALSE
            }
            frame "623", "E101", "E102", "E201", "E202", "E523", "E61", "E61T", "E62", "E623", "G101", "G102", "G201", "G202", "G61", "G62" {
              w1 = "✅"
              w3 = $"Error input"
              w2 = TRUE
            }
          }
        }
      }
    }
  }
  $"i Combi Pro ?" <- w2
  $"Error Output" <- w3
  $"HACCP File Content" <- w1
