vi "Get_Details_selected_programme.gviweb"   [G Web Development Software 22.3.0]
inputs:
  "Array": string[]
  "Start date and time": string
  "Error input": error
outputs:
  "Programme Details": T2[]
  "Output Error": error
  "Curve singel": T1[]
  "time stamp": timestamp[]
  "Curve double": cluster{"Element 1": f64[], "Element 2": f64[]}[]
  "Average temp.": f64
  "max value": f64
panel indicators:
  "date and time": string[]
  "Temp. Unit": string[]
  "Zeiten in sekunden": f64[]
  "Output": f64[]
  "core sensor curent point": f64[]
  "chamber temp": f64[]
  "core sensor setpoint": f64[]
types:
  T1 = cluster{"Element 1": timestamp[], "Element 2": f64[]}
  T2 = cluster{"Mode/ Event": string, "cabinet temp.": string, "core temp. Target": string, "core temp.": string, "Date and time": string}
uses:
  NI::G Core::Strings::Trim Whitespace.gvi
  WebApp::Add_offset_time_txt.gviweb
  NI::G Core::Strings::Search and Replace Pattern.gvi
diagram:
  s1 = 0  # shift register
  for {
    w1 = each element of $Array
    s2 = ""  # shift register
    s3 = f64[] []  # shift register
    s4 = f64[] []  # shift register
    s5 = f64[] []  # shift register
    s6 = string[] []  # shift register
    s7 = uninitialised  # shift register
    s8 = string[] []  # shift register
    s9 = string[] []  # shift register
    s10 = uninitialised  # shift register
    s11 = uninitialised  # shift register
    s12 = uninitialised  # shift register
    s13 = uninitialised  # shift register
    s14 = timestamp[] []  # shift register
    s15 = s1  # shift register
    s16 = f64[] []  # shift register
    while (iteration -> i1) {
      # s9: temp. unit
      # s11: core probre setpoint temp.
      # s12: core probe curent temp.
      # s10: chamber temp.
      case (i1) {
        frame 1, Default {
          call "Trim Whitespace.gvi"(string=s2, location="both"(0)) -> (trimmed string=w25)
          Scan Value(format string="%3s", string=w25) -> (output string=w26, value=w18)
          call "Trim Whitespace.gvi"(string=w26, location="both"(0)) -> (trimmed string=w27)
          Scan Value(format string="%3s", string=w27) -> (output string=w28, value=w29)
          case (w29) {
            frame 0 {
              Match Pattern(regular expression="-", string=w28)
              String Subset(offset (0)=1, string=w28) -> w30
              w19 = 0
            }
            frame 1, Default {
              w19 = w29
              w30 = w28
            }
          }
          call "Trim Whitespace.gvi"(string=w30, location="both"(0)) -> (trimmed string=w31)
          Scan Value(format string="%3s", string=w31) -> (output string=w32, value=w20)
          call "Trim Whitespace.gvi"(string=w32, location="both"(0)) -> (trimmed string=w33)
          Scan From String(formatString="%9s", inputString=w33) -> (outString=w34, out0=w35)
          Scan From String(formatString="%s", inputString=w34) -> (outString=w36, out0=w21)
          Match Pattern(regular expression="\n", string=w36) -> (after substring=w8)
          Is Empty String Or Path(string/path=w8) -> w14
          Insert Into Array(inArray=s9, new=w21) -> w17
          call "Add_offset_time_txt.gviweb"(Start date and time=$"Start date and time", time offset (sec)=w35, Error input=$"Error input") -> (Date and time=w37, timestamp=w38, Duration in seconds=w39, Output Error=w16)
          Insert Into Array(inArray=s8, new=w37) -> w15
          Insert Into Array(inArray=s14, new=w38) -> w22
          Insert Into Array(inArray=s5, new=w20) -> w11
          Insert Into Array(inArray=s4, new=w19) -> w10
          Insert Into Array(inArray=s3, new=w18) -> w9
          Insert Into Array(inArray=s6, new=s7) -> w12
          Insert Into Array(inArray=s16, new=w39) -> w24
          w13 = s7
          w23 = s15
        }
        frame 0 {
          Match Pattern(regular expression=";", string=w1) -> (after substring=w40)
          Match Pattern(regular expression="/", string=w40) -> (before substring=w41, match substring=w42)
          case (w42) {
            frame "False", Default {
              Match Pattern(regular expression=")", string=w40) -> (after substring=w43, before substring=w44, match substring=w45)
              case (w45) {
                frame ")" {
                  Concatenate Strings(w44, w45) -> w47
                  call "Trim Whitespace.gvi"(string=w47) -> (trimmed string=w46)
                  Match Pattern(regular expression="\n", string=w43) -> (after substring=w48)
                  call "Trim Whitespace.gvi"(string=w43) -> (trimmed string=w49)
                  Is Empty String Or Path(string/path=w48) -> w50
                  case (w50) {
                    frame False, Default {
                      w8 = w48
                      w15 = s8
                      w9 = s3
                      w10 = s4
                      w11 = s5
                      w17 = s9
                      w16 = $"Error input"
                      w22 = s14
                      w24 = s16
                    }
                    frame True {
                      call "Add_offset_time_txt.gviweb"(Start date and time=$"Start date and time", time offset (sec)=w49, Error input=$"Error input") -> (Date and time=w51, timestamp=w52, Duration in seconds=w53, Output Error=w16)
                      Insert Into Array(inArray=s8, new=w51) -> w15
                      Insert Into Array(inArray=s14, new=w52) -> w22
                      Insert Into Array(inArray=s4, new=s11) -> w10
                      Insert Into Array(inArray=s3, new=s10) -> w9
                      Insert Into Array(inArray=s5, new=s12) -> w11
                      Insert Into Array(inArray=s9, new=s13) -> w17
                      Insert Into Array(inArray=s16, new=w53) -> w24
                      w8 = w48
                    }
                  }
                }
                frame "False", Default {
                  Match Pattern(regular expression="ELC", string=w40) -> (after substring=w54, before substring=w55, match substring=w56)
                  case (w56) {
                    frame "ELC" {
                      Concatenate Strings(w56, w55) -> w57
                      call "Trim Whitespace.gvi"(string=w57) -> (trimmed string=w46)
                      Match Pattern(regular expression="\n", string=w54) -> (after substring=w58)
                      call "Trim Whitespace.gvi"(string=w54) -> (trimmed string=w59)
                      Is Empty String Or Path(string/path=w58) -> w60
                      case (w60) {
                        frame False, Default {
                          w8 = w58
                          w15 = s8
                          w9 = s3
                          w10 = s4
                          w11 = s5
                          w17 = s9
                          w16 = $"Error input"
                          w22 = s14
                          w24 = s16
                        }
                        frame True {
                          call "Add_offset_time_txt.gviweb"(Start date and time=$"Start date and time", time offset (sec)=w59, Error input=$"Error input") -> (Date and time=w61, timestamp=w62, Output Error=w16)
                          Insert Into Array(inArray=s8, new=w61) -> w15
                          Insert Into Array(inArray=s14, new=w62) -> w22
                          Insert Into Array(inArray=s4, new=s11) -> w10
                          Insert Into Array(inArray=s3, new=s10) -> w9
                          Insert Into Array(inArray=s5, new=s12) -> w11
                          Insert Into Array(inArray=s9, new=s13) -> w17
                          w8 = w58
                          w24 = s16
                        }
                      }
                    }
                    frame "False", Default {
                      Match Pattern(regular expression="Microwave", string=w40) -> (after substring=w63, match substring=w64)
                      Match Pattern(regular expression="Broken: ", string=w63) -> (after substring=w65, before substring=w66, match substring=w67)
                      String Subset(length (rest)=2, string=w65) -> w68
                      Concatenate Strings(w64, w66, w67, w68) -> w69
                      call "Trim Whitespace.gvi"(string=w69) -> (trimmed string=w46)
                      Match Pattern(regular expression="\n", string=w65) -> (after substring=w70)
                      call "Trim Whitespace.gvi"(string=w65) -> (trimmed string=w71)
                      Is Empty String Or Path(string/path=w70) -> w72
                      case (w72) {
                        frame False, Default {
                          w8 = w70
                          w15 = s8
                          w9 = s3
                          w10 = s4
                          w11 = s5
                          w17 = s9
                          w16 = $"Error input"
                          w22 = s14
                          w24 = s16
                        }
                        frame True {
                          call "Add_offset_time_txt.gviweb"(Start date and time=$"Start date and time", time offset (sec)=w71, Error input=$"Error input") -> (Date and time=w73, timestamp=w74, Duration in seconds=w75, Output Error=w16)
                          Insert Into Array(inArray=s8, new=w73) -> w15
                          Insert Into Array(inArray=s14, new=w74) -> w22
                          Insert Into Array(inArray=s4, new=s11) -> w10
                          Insert Into Array(inArray=s3, new=s10) -> w9
                          Insert Into Array(inArray=s5, new=s12) -> w11
                          Insert Into Array(inArray=s9, new=s13) -> w17
                          Insert Into Array(inArray=s16, new=w75) -> w24
                          w8 = w70
                        }
                      }
                    }
                  }
                }
              }
              case (w46) {
                frame "False", Default {
                  w13 = w46
                }
                frame "end (RETURN)" {
                  w13 = "Program finished with back button"
                }
                frame "end (ERROR)" {
                  w13 = "Program was aborted \ndue to error"
                }
                frame "end (ABORT)" {
                  w13 = "Program was aborted"
                }
                frame "stop (END)" {
                  w13 = "end of Program is reached"
                }
                frame "end (HOME)" {
                  w13 = "Program finished with home button"
                }
                frame "restart (POWER)" {
                  w13 = "Restart after switching off \nor power failure "
                }
              }
            }
            frame "/" {
              Match Pattern(regular expression="\n", string=w40) -> (after substring=w8)
              call "Search and Replace Pattern.gvi"(string=w41, pattern="(EN)") -> (result string=w76)
              call "Trim Whitespace.gvi"(string=w76) -> (trimmed string=w77)
              Match Pattern(regular expression="Handshower", string=w77) -> (match substring=w78)
              case (w78) {
                frame "False", Default {
                  Match Pattern(regular expression=":", string=w77) -> (match substring=w79)
                  case (w79) {
                    frame "False", Default {
                      w13 = w77
                    }
                    frame ":" {
                      call "Search and Replace Pattern.gvi"(string=w77, pattern=":", replace string="\n") -> (result string=w13)
                    }
                  }
                }
                frame "Handshower" {
                  w13 = w78
                }
              }
              w15 = s8
              w9 = s3
              w10 = s4
              w11 = s5
              w17 = s9
              w16 = $"Error input"
              w22 = s14
              w24 = s16
            }
          }
          Insert Into Array(inArray=s6, new=w13) -> w12
          Is Empty String Or Path(string/path=w8) -> w14
          w18 = s10
          w19 = s11
          w20 = s12
          w21 = s13
          w23 = s15
        }
      }
      Is Greater(x=w23, y=w18) -> w80
      case (w80) {
        frame False, Default {
          w81 = w18
        }
        frame True {
          w81 = w23
        }
      }
      next s2 = w8
      next s3 = w9
      next s4 = w10
      next s5 = w11
      next s6 = w12
      next s7 = w13
      next s8 = w15
      next s9 = w17
      next s10 = w18
      next s11 = w19
      next s12 = w20
      next s13 = w21
      next s14 = w22
      next s15 = w81
      next s16 = w24
      stop if w14
    }
    $"Output Error" <- w16
    for (after s14) {
      w82 = each element of s6
      w83 = each element of s3
      w84 = each element of s4
      w85 = each element of s5
      w86 = each element of s8
      w87 = each element of s9
      Number To Fractional String(number=w83, precision (6)=0) -> (F-format string=w89)
      Concatenate Strings(w89, " ", w87) -> w90
      Number To Fractional String(number=w84, precision (6)=0) -> (F-format string=w91)
      case (w91) {
        frame "False", Default {
          w92 = w91
          w93 = w87
        }
        frame "0" {
          w92 = "-"
          w93 = ""
        }
      }
      Concatenate Strings(w92, " ", w93) -> w94
      Number To Fractional String(number=w85, precision (6)=0) -> (F-format string=w95)
      Concatenate Strings(w95, " ", w87) -> w96
      Property Node(instance in=T2 {all zero or empty}, "Mode/ Event"=w82, "cabinet temp."=w90, "core temp. Target"=w94, "core temp."=w96, "Date and time"=w86) -> (instance out=w97)
      append w97 to w88
    }
    $"date and time" <- s8
    $"Temp. Unit" <- s9
    concatenate w88 onto w2
    concatenate s3 onto w3
    concatenate s4 onto w4
    concatenate s5 onto w5
    concatenate s14 onto w6
    concatenate s16 onto w7
    next s1 = s15
  }
  Build Cluster(w6, w3) -> w98
  Build Cluster(w6, w4) -> w99
  Build Cluster(w6, w5) -> w100
  s17 = f64[] []  # shift register
  for {
    w101 = each element of w2
    Property Node(instance in=w101) -> ("Mode/ Event"=w102)
    case (w102) {
      frame "False", Default {
        Insert Into Array(inArray=s17, new=0) -> w103
      }
      frame "Door opened" {
        Insert Into Array(inArray=s17, new=s1) -> w103
      }
      frame "Lid not closed" {
        Insert Into Array(inArray=s17, new=s1) -> w103
      }
    }
    next s17 = w103
  }
  Build Cluster(w6, s17) -> w104
  Build Array(w98, w99, w100, w104) -> w105
  $"Curve singel" <- w105
  $"time stamp" <- w6
  $"max value" <- s1
  $"core sensor setpoint" <- w4
  $"core sensor curent point" <- w5
  $Output <- s17
  $"Programme Details" <- w2
  $"chamber temp" <- w3
  s18 = 0  # shift register
  for {
    w106 = each element of w3
    Add(s18, w106) -> w107
    next s18 = w107
  }
  Array Size(array=w3) -> (size(s)=w108)
  Divide(x=s18, y=w108) -> w109
  $"Average temp." <- w109
  $"Zeiten in sekunden" <- w7
  Build Cluster(w7, w3) -> w110
  Build Cluster(w7, w4) -> w111
  Build Cluster(w7, w5) -> w112
  Build Cluster(w7, s17) -> w113
  Build Array(w110, w111, w112, w113) -> w114
  $"Curve double" <- w114
