vi "Get_Details_selected_programme_iCC.gviweb"   [G Web Development Software 22.3.0]
inputs:
  "Get all charge": string[]
  "Charge Name": string[]
  "Error in": error
  "Charge infos": T3[]
outputs:
  "Details of the selected programme:": cluster{"Entry": string, "Information": string}[]
  "Error out": error
  "Curve singel": T2[]
  "Details of selected infos": T1[]
  "Curve double": cluster{"Element 1": f64[], "Element 2": i32[]}[]
  "Cleaning error found?": bool
panel controls:
  "String": string = " CLEAN STEP 001\t\t02.04.25 / 11:52:28"
panel indicators:
  "First charge": string
  "before substring": string
  "Output_5": string
  "Date and time": string[]
  "Mode Event": string[]
  "cabinet temp. target": string[]
  "cabinet temp.": string[]
  "core temp.": string[]
  "Einheit": string[]
  "core temp. target": string[]
  "Cabinet temp. array (1)": i32[]
  "Cabinet temp. target array (2)": i32[]
  "Core temp.target array (4)": i32[]
  "Core temp. array (3)": i32[]
  "timestamp": timestamp[]
  "Details in line": string[]
types:
  T1 = cluster{"Mode/ Event": string, "cabinet temp. target": string, "cabinet temp.": string, "core temp. target": string, "core temp.": string, "Date and time": string}
  T2 = cluster{"Element 1": timestamp[], "Element 2": i32[]}
  T3 = cluster{"selected": bool, "Charge Nr.": string, "Process name": string, "Programme name": string, "Date and time": string, "Duration": string, "Status": string, "Average temp.": string}
uses:
  NI::G Core::Strings::Trim Whitespace.gvi
  NI::G Core::Strings::Search and Replace Pattern.gvi
  WebApp::Get_Duration_iCC.gviweb
  WebApp::Get_Process_and_Prgramme_name_iCC.gviweb
  WebApp::Get_Duration_If_Stop_Missing.gviweb
  WebApp::Calculate_duration_for_iCC.gviweb
diagram:
  Array Index(array=$"Charge Name") -> (out0[0]=w1)
  Match Pattern(regular expression="Charge Nr:", string=w1) -> (after substring=w2)
  call "Trim Whitespace.gvi"(string=w2) -> (trimmed string=w3)
  s1 = FALSE  # shift register
  for {
    w4 = each element of $"Get all charge"
    Match Pattern(regular expression="ERROR", string=w4) -> (match substring=w5)
    case (w5) {
      frame "False", Default {
        w6 = s1
      }
      frame "ERROR" {
        w6 = TRUE
      }
    }
    Decimal String To Number(string=w3) -> (number=w7)
    Match Pattern(regular expression="Ch-nr.", string=w4) -> (after substring=w8)
    Match Pattern(regular expression="<<", string=w8) -> (before substring=w9)
    call "Search and Replace Pattern.gvi"(string=w9, pattern=">>") -> (result string=w10)
    call "Trim Whitespace.gvi"(string=w10) -> (trimmed string=w11)
    Decimal String To Number(string=w11) -> (number=w12)
    Is Equal(x=w7, y=w12) -> w13
    next s1 = w6
    stop if w13
  }
  Insert Into Array(inArray=string[] [], new=w4) -> w14
  for {
    w15 = each element of $"Charge infos"
    Property Node(instance in=w15) -> ("Charge Nr."=w16, "Average temp."=w17)
    Decimal String To Number(string=w16) -> (number=w18)
    Decimal String To Number(string=w11) -> (number=w19)
    Is Equal(x=w19, y=w18) -> w20
    stop if w20
  }
  for (iteration -> i1) {
    w21 = each element of w14
    Match Pattern(regular expression="end", string=w21) -> (match substring=w22)
    case (w22) {
      frame "end" {
        w23 = "Completed"
      }
      frame "ABORT" {
        w23 = "Aborted"
      }
      frame "false", Default {
        w23 = "Aborted/ Canceled"
      }
    }
    Match Pattern(regular expression="Ch-nr.", string=w21) -> (after substring=w24)
    Match Pattern(regular expression="<<", string=w24) -> (before substring=w25)
    call "Search and Replace Pattern.gvi"(string=w25, pattern=">>") -> (result string=w26)
    call "Trim Whitespace.gvi"(string=w26) -> (trimmed string=w27)
    case (i1) {
      frame 0 {
        $"First charge" <- w27
        w28 = TRUE
      }
      frame 1, Default {
        w28 = FALSE
      }
    }
    call "Trim Whitespace.gvi"(string=w21) -> (trimmed string=w29)
    call "Get_Duration_iCC.gviweb"(Charge infos=w21, Error Input=$"Error in") -> (Start Date and Time=w30, Output Error=w31)
    call "Get_Process_and_Prgramme_name_iCC.gviweb"(Charge infos=w29, Input=w31) -> (Process name=w32, Programme name=w33, Output=w34)
    call "Trim Whitespace.gvi"(string=w30) -> (trimmed string=w35)
    call "Get_Duration_If_Stop_Missing.gviweb"(Charge infos=w21, Error input=w34) -> (Last date and time=w36, Error ouput=w37)
    call "Calculate_duration_for_iCC.gviweb"(Start date and time=w30, Last date and time=w36, Error input=w37) -> (Duration=w38, Output Error=w39)
    Property Node(instance in=T3 {all zero or empty}, "selected"=w28, "Charge Nr."=w27, "Process name"=w32, "Programme name"=w33, "Date and time"=w35, "Duration"=w38, "Status"=w23, "Average temp."=w17) -> (instance out=w40)
  }
  Property Node(instance in=w40) -> ("Charge Nr."=w41, "Process name"=w42, "Programme name"=w43, "Date and time"=w44, "Duration"=w45, "Status"=w46, "Average temp."=w47)
  Insert Into Array(inArray=string[] [], new=w41, new=w42, new=w43, new=w44, new=w45, new=w46, new=w47) -> w48
  w49 = ["Charge Nr.:", "Process name", "Programme name", "Start date and time:", "Duration: ", "Status:", "Average temperature:"]
  for {
    w50 = each element of w49
    w51 = each element of w48
    w53 = cluster{"Entry": string, "Information": string} {all zero or empty}
    Property Node(instance in=w53, "Entry"=w50, "Information"=w51) -> (instance out=w54)
    append w54 to w52
  }
  s2 = ""  # shift register
  s3 = string[] []  # shift register
  while (iteration -> i2) {
    Match Pattern(regular expression="Handshower", string=w21) -> (after substring=w55)
    case (i2) {
      frame 0 {
        Match Pattern(regular expression="\n", string=w55) -> (after substring=w56)
        w57 = s3
      }
      frame 1, Default {
        Match Pattern(regular expression=";", string=s2) -> (after substring=w56, before substring=w58, match substring=w59)
        Concatenate Strings(w59, w58) -> w60
        call "Trim Whitespace.gvi"(string=w60) -> (trimmed string=w61)
        Insert Into Array(inArray=s3, new=w61) -> w57
      }
    }
    Is Empty String Or Path(string/path=w56) -> w62
    next s2 = w56
    next s3 = w57
    stop if w62
  }
  $"Details in line" <- s3
  s4 = string[] []  # shift register
  for {
    w63 = each element of s3
    Match Pattern(regular expression=";", string=w63) -> (after substring=w64, match substring=w65)
    case (w65) {
      frame "False", Default {
        w66 = s4
      }
      frame ";" {
        Is Empty String Or Path(string/path=w64) -> w67
        case (w67) {
          frame False, Default {
            s5 = ""  # shift register
            s6 = s4  # shift register
            while (iteration -> i3) {
              $Output_5 <- w64
              case (i3) {
                frame 0 {
                  Match Pattern(regular expression="/", string=w64) -> (after substring=w70, before substring=w71, match substring=w72)
                  Match Pattern(regular expression="\n", string=w70) -> (after substring=w68, before substring=w73)
                  Match Pattern(regular expression="/", string=w73) -> (before substring=w74)
                  Concatenate Strings(w71, w72, w74) -> w75
                  Insert Into Array(inArray=s6, new=w75) -> w69
                  $"before substring" <- w68
                }
                frame 1, Default {
                  Match Pattern(regular expression="/", string=s5) -> (after substring=w76, before substring=w77, match substring=w78)
                  Match Pattern(regular expression="\n", string=w76) -> (after substring=w68, before substring=w79)
                  Match Pattern(regular expression="/", string=w79) -> (before substring=w80)
                  Concatenate Strings(w77, w78, w80) -> w81
                  Insert Into Array(inArray=s6, new=w81) -> w69
                }
              }
              Is Empty String Or Path(string/path=w68) -> w82
              next s5 = w68
              next s6 = w69
              stop if w82
            }
            w66 = s6
          }
          frame True {
            w66 = s4
          }
        }
      }
    }
    next s4 = w66
  }
  s7 = string[] []  # shift register
  s8 = ""  # shift register
  s9 = string[] []  # shift register
  s10 = ""  # shift register
  s11 = string[] []  # shift register
  s12 = "---"  # shift register
  s13 = string[] []  # shift register
  s14 = "---"  # shift register
  s15 = string[] []  # shift register
  s16 = "---"  # shift register
  s17 = string[] []  # shift register
  s18 = "---"  # shift register
  s19 = string[] []  # shift register
  s20 = "---"  # shift register
  for {
    w83 = each element of s4
    Match Pattern(regular expression="/", string=w83) -> (after substring=w84, before substring=w85, match substring=w86)
    Match Pattern(regular expression="\t", string=w85) -> (after substring=w87, before substring=w88)
    Scan From String(formatString="%s", inputString=w85, startLoc=0) -> (out0=w89)
    Decimal String To Number(string=w89) -> (number=w90)
    Is Greater Than 0(x=w90) -> w91
    case (w91) {
      frame False, Default {
        Match Pattern(regular expression="end", string=w88) -> (match substring=w94)
        case (w94) {
          frame "end" {
            Insert Into Array(inArray=s7, new=w94) -> w92
            call "Trim Whitespace.gvi"(string=w88) -> (trimmed string=w93)
          }
          frame "False", Default {
            call "Trim Whitespace.gvi"(string=w88) -> (trimmed string=w93)
            Insert Into Array(inArray=s7, new=w93) -> w92
          }
        }
      }
      frame True {
        call "Trim Whitespace.gvi"(string=s8) -> (trimmed string=w93)
        Insert Into Array(inArray=s7, new=w93) -> w92
      }
    }
    String Subset(length (rest)=9, string=w84) -> w95
    Concatenate Strings(w87, w86, w95) -> w96
    call "Trim Whitespace.gvi"(string=w96) -> (trimmed string=w97)
    String Length(string=w97) -> (length=w98)
    Is Greater(x=w98, y=25) -> w99
    case (w99) {
      frame True {
        Match Pattern(regular expression="/", string=w97) -> (after substring=w112, before substring=w113, match substring=w114)
        call "Trim Whitespace.gvi"(string=w113) -> (trimmed string=w115)
        String Subset(length (rest)=3, string=w115) -> w103
        Insert Into Array(inArray=s11, new=w103) -> w102
        call "Search and Replace Pattern.gvi"(string=w115, pattern="\t", replace all=FALSE) -> (result string=w116)
        call "Trim Whitespace.gvi"(string=w116) -> (trimmed string=w117)
        String Subset(length (rest)=4, offset (0)=3, string=w117) -> w118
        call "Search and Replace Pattern.gvi"(string=w118, pattern="\t", replace all=TRUE) -> (result string=w105)
        Insert Into Array(inArray=s13, new=w105) -> w104
        Reverse String(string=w113) -> (reversed=w119)
        String Subset(length (rest)=4, offset (0)=13, string=w119) -> w111
        call "Trim Whitespace.gvi"(string=w111, location="both"(0)) -> (trimmed string=w120)
        call "Search and Replace Pattern.gvi"(string=w120, pattern="\t", replace all=TRUE) -> (result string=w121)
        Insert Into Array(inArray=s19, new=w121) -> w110
        call "Trim Whitespace.gvi"(string=w112) -> (trimmed string=w122)
        String Subset(length (rest)=2, offset (0)=9, string=w122) -> w109
        Insert Into Array(inArray=s17, new=w109) -> w108
        String Subset(length (rest)=4, offset (0)=9, string=w119) -> w123
        Reverse String(string=w123) -> (reversed=w107)
        call "Search and Replace Pattern.gvi"(string=w107, pattern="\t", replace all=TRUE) -> (result string=w124)
        Insert Into Array(inArray=s15, new=w124) -> w106
        String Subset(length (rest)=9, string=w112) -> w125
        String Subset(length (rest)=9, string=w119) -> w126
        Reverse String(string=w126) -> (reversed=w127)
        Concatenate Strings(w127, w114, w125) -> w128
        Insert Into Array(inArray=s9, new=w128) -> w100
        w101 = s10
      }
      frame False {
        Insert Into Array(inArray=s11, new=s12) -> w102
        Insert Into Array(inArray=s13, new=s14) -> w104
        Insert Into Array(inArray=s19, new=s20) -> w110
        Insert Into Array(inArray=s15, new=s16) -> w106
        Insert Into Array(inArray=s17, new=s18) -> w108
        String Length(string=w97) -> (length=w129)
        Is Greater(x=w129, y=13) -> w130
        case (w130) {
          frame True {
            Insert Into Array(inArray=s9, new=w97) -> w100
            w101 = w97
          }
          frame False {
            Insert Into Array(inArray=s9, new=w97) -> w100
            w101 = w97
          }
        }
        w103 = s12
        w105 = s14
        w107 = s16
        w109 = s18
        w111 = s20
      }
    }
    next s7 = w92
    next s8 = w93
    next s9 = w100
    next s10 = w101
    next s11 = w102
    next s12 = w103
    next s13 = w104
    next s14 = w105
    next s15 = w106
    next s16 = w107
    next s17 = w108
    next s18 = w109
    next s19 = w110
    next s20 = w111
  }
  s21 = string[] []  # shift register
  s22 = ""  # shift register
  for {
    w131 = each element of s9
    String Length(string=w131) -> (length=w132)
    Is Greater(x=w132, y=13) -> w133
    case (w133) {
      frame True {
        Insert Into Array(inArray=s21, new=w131) -> w134
        w135 = w131
      }
      frame False {
        Insert Into Array(inArray=s21, new=s22) -> w134
        w135 = s22
      }
    }
    next s21 = w134
    next s22 = w135
  }
  s23 = ""  # shift register
  s24 = u64[] []  # shift register
  s25 = 0  # shift register
  s26 = 0  # shift register
  for {
    w136 = each element of s21
    w137 = each element of s7
    w138 = each element of s11
    w139 = each element of s13
    w140 = each element of s19
    w141 = each element of s15
    w142 = each element of s17
    Is Empty String Or Path(string/path=w136) -> w144
    case (w144) {
      frame False, Default {
        Concatenate Strings(w136, " ", w142) -> w145
      }
      frame True {
        w145 = s23
      }
    }
    Decimal String To Number(string=w139) -> (number=w146)
    Number To Decimal String(number=w146) -> (decimal integer string=w147)
    case (w147) {
      frame "False", Default {
        Concatenate Strings(w147, " ", w142) -> w148
      }
      frame "0" {
        w148 = "---"
      }
    }
    Decimal String To Number(string=w140) -> (number=w149)
    Number To Decimal String(number=w149) -> (decimal integer string=w150)
    case (w150) {
      frame "False", Default {
        Concatenate Strings(w150, " ", w142) -> w151
      }
      frame "0" {
        w151 = "---"
      }
    }
    Decimal String To Number(string=w141) -> (number=w152)
    Number To Decimal String(number=w152) -> (decimal integer string=w153)
    case (w153) {
      frame "False", Default {
        Concatenate Strings(w153, " ", w142) -> w154
      }
      frame "0" {
        w154 = "---"
      }
    }
    call "Search and Replace Pattern.gvi"(string=w138, pattern="\t", replace all=TRUE) -> (result string=w155)
    Concatenate Strings(w155, " ", w142) -> w156
    Property Node(instance in=T1 {all zero or empty}, "Mode/ Event"=w137, "cabinet temp. target"=w156, "cabinet temp."=w148, "core temp. target"=w151, "core temp."=w154, "Date and time"=w145) -> (instance out=w157)
    case (w137) {
      frame "False", Default {
        Insert Into Array(inArray=s24, new=s25) -> w158
        w159 = s25
      }
      frame "Door opened" {
        Insert Into Array(inArray=s24, new=1) -> w158
        w159 = 1
      }
      frame "Door closed" {
        Insert Into Array(inArray=s24, new=0) -> w158
        w159 = 0
      }
    }
    Is Greater(x=w146, y=s26) -> w160
    case (w160) {
      frame False, Default {
        w161 = s26
      }
      frame True {
        w161 = w146
      }
    }
    append w157 to w143
    next s23 = w145
    next s24 = w158
    next s25 = w159
    next s26 = w161
  }
  s27 = i32[] []  # shift register
  s28 = i32[] []  # shift register
  s29 = i32[] []  # shift register
  s30 = i32[] []  # shift register
  s31 = timestamp[] []  # shift register
  s32 = i32[] []  # shift register
  s33 = f64[] []  # shift register
  for {
    w162 = each element of w143
    w163 = each element of s24
    Multiply(w163, s26) -> w164
    Property Node(instance in=w162) -> ("cabinet temp. target"=w165, "cabinet temp."=w166, "core temp. target"=w167, "core temp."=w168, "Date and time"=w169)
    Decimal String To Number(string=w167) -> (number=w170)
    Decimal String To Number(string=w168) -> (number=w171)
    Decimal String To Number(string=w166) -> (number=w172)
    Match Pattern(regular expression="/", string=w169) -> (after substring=w173)
    Decimal String To Number(string=w165) -> (number=w174)
    call "Search and Replace Pattern.gvi"(string=w169, pattern="-", replace all=TRUE) -> (result string=w175)
    call "Calculate_duration_for_iCC.gviweb"(Start date and time=w44, Last date and time=w175, Error input=w39) -> (TimeStamp=w176, Duration time=w177, Output Error=w178)
    Is Equal To 0(x=w172) -> w179
    case (w179) {
      frame True {
        w180 = s27
        w181 = s28
        w182 = s29
        w183 = s30
        w184 = s31
        w185 = s32
        w186 = w178
        w187 = s33
      }
      frame False {
        Insert Into Array(inArray=s27, new=w172) -> w180
        Insert Into Array(inArray=s28, new=w174) -> w181
        Insert Into Array(inArray=s31, new=w176) -> w184
        Insert Into Array(inArray=s33, new=w177) -> w187
        Insert Into Array(inArray=s30, new=w171) -> w183
        Insert Into Array(inArray=s29, new=w170) -> w182
        Insert Into Array(inArray=s32, new=w164) -> w185
        w186 = w178
      }
    }
    next s27 = w180
    next s28 = w181
    next s29 = w182
    next s30 = w183
    next s31 = w184
    next s32 = w185
    next s33 = w187
  }
  $"Error out" <- w186
  $"Cleaning error found?" <- s1
  Build Cluster(s31, s27) -> w188
  Build Cluster(s31, s28) -> w189
  Build Cluster(s31, s30) -> w190
  Build Cluster(s31, s29) -> w191
  Build Cluster(s31, s32) -> w192
  Build Array(w188, w189, w190, w191, w192) -> w193
  $"Curve singel" <- w193
  $timestamp <- s31
  $"Details of selected infos" <- w143
  $"Cabinet temp. array (1)" <- s27
  $"Cabinet temp. target array (2)" <- s28
  $"Mode Event" <- s7
  $"Date and time" <- s21
  $"Details of the selected programme:" <- w52
  $"Core temp. array (3)" <- s30
  $"cabinet temp. target" <- s11
  $"Core temp.target array (4)" <- s29
  $"cabinet temp." <- s13
  $Einheit <- s17
  Build Cluster(s33, s27) -> w194
  Build Cluster(s33, s28) -> w195
  Build Cluster(s33, s30) -> w196
  Build Cluster(s33, s29) -> w197
  Build Cluster(s33, s32) -> w198
  Build Array(w194, w195, w196, w197, w198) -> w199
  $"Curve double" <- w199
  $"core temp. target" <- s19
  $"core temp." <- s15
