vi "Specifications_haccp.gviweb"   [G Web Development Software 22.3.0]
inputs:
  "Output XML array": string[]
  "Error in": error
  "Energy consumption:": string
outputs:
  "Device Type": string
  "Unit temp.": string
  "Error out": error
  "Start date": string
  "Serial number": string
  "Rezept name": string
  "Charge nr": string
  "Specifications": T1
panel indicators:
  "GUID": string
  "Software version": string
types:
  T1 = cluster{"Device type:": string, "Serial number:": string, "Software version:": string, "Start date:": string, "Charge number:": string, "Prozess-Typ:": string, "Cooking programme name": string, "Energy consumption:": string}
  T2 = cluster{"Device type:": string, "Serial number:": string, "Software version:": string, "Start date:": string, "Charge number:": string, "Prozess-Typ:": string, "Cooking programme name:": string, "Energy consumption:": string}
uses:
  NI::G Core::Strings::Trim Whitespace.gvi
diagram:
  s1 = ""  # shift register
  s2 = ""  # shift register
  s3 = ""  # shift register
  s4 = ""  # shift register
  s5 = ""  # shift register
  s6 = ""  # shift register
  s7 = ""  # shift register
  for {
    w1 = each element of $"Output XML array"
    Match Pattern(regular expression=">", string=w1) -> (after substring=w2, before substring=w3)
    Match Pattern(regular expression="</", string=w2) -> (before substring=w4)
    case (w3) {
      frame "False", Default {
        w5 = s1
        w6 = s2
        w7 = s3
        w8 = s4
        w9 = s5
        w10 = $"Error in"
        w11 = s6
        w12 = s7
      }
      frame "1.6/" {
        Match Pattern(regular expression="<_1.7>", string=w4) -> (after substring=w7)
        w5 = s1
        w6 = s2
        w8 = s4
        w9 = s5
        w10 = $"Error in"
        w11 = s6
        w12 = s7
      }
      frame "1.11" {
        w5 = s1
        w6 = s2
        w7 = s3
        w8 = s4
        w9 = s5
        w10 = $"Error in"
        w11 = s6
        w12 = w4
      }
      frame "1.16" {
        w5 = s1
        w6 = s2
        w7 = s3
        w8 = s4
        w9 = s5
        w10 = $"Error in"
        w11 = w4
        w12 = s7
      }
      frame "1.10" {
        w5 = s1
        w6 = s2
        w7 = s3
        w8 = s4
        w9 = w4
        w10 = $"Error in"
        w11 = s6
        w12 = s7
      }
      frame "1.4" {
        w5 = s1
        w6 = s2
        w7 = s3
        w8 = w4
        w9 = s5
        w10 = $"Error in"
        w11 = s6
        w12 = s7
      }
      frame "1.7" {
        w5 = s1
        w6 = s2
        w7 = w4
        w8 = s4
        w9 = s5
        w10 = $"Error in"
        w11 = s6
        w12 = s7
      }
      frame "1.2" {
        w5 = w4
        w6 = s2
        w7 = s3
        w8 = s4
        w9 = s5
        w10 = $"Error in"
        w11 = s6
        w12 = s7
      }
      frame "1.5" {
        w5 = s1
        w6 = w4
        w7 = s3
        w8 = s4
        w9 = s5
        w10 = $"Error in"
        w11 = s6
        w12 = s7
      }
    }
    next s1 = w5
    next s2 = w6
    next s3 = w7
    next s4 = w8
    next s5 = w9
    next s6 = w11
    next s7 = w12
  }
  $"Software version" <- s2
  call "Trim Whitespace.gvi"(string=s5) -> (trimmed string=w13)
  call "Trim Whitespace.gvi"(string=s6) -> (trimmed string=w14)
  case (w13) {
    frame "False", Default {
      case (w14) {
        frame "False", Default {
          w16 = w10
          w17 = "not found"
        }
        frame "{EA737657-9418-4E57-A421-4D15320E0F7F}" {
          w16 = w10
          w17 = "Side Dishes Steam"
        }
        frame "{4F9F0189-756A-4075-9A52-38584C12BA3E}" {
          w16 = w10
          w17 = "Side Dishes Grill"
        }
        frame "{033C529F-D5AB-4D63-9EDC-AD73F78F20BA}" {
          w16 = w10
          w17 = "Side Dishes \nPotato Gratin"
        }
        frame "{D9283896-1EFB-4710-BFC2-B421480CC204}" {
          w16 = w10
          w17 = "Fish Steam"
        }
        frame "{30AC8E8B-C87A-447A-95DB-D7654C3816E1}" {
          w16 = w10
          w17 = "Fish Breaded"
        }
        frame "{8814B967-C36C-488F-B294-577BD78321B0}" {
          w16 = w10
          w17 = "Meat Breaded"
        }
        frame "{52927445-3733-4808-A24A-1DBC5BAE450E}" {
          w16 = w10
          w17 = "Poultry Pan-Fry"
        }
        frame "{3F83B928-3602-41D9-88B8-D167F3128877}" {
          w16 = w10
          w17 = "Meat Grill"
        }
        frame "{3EAB14A4-BAD3-4A6A-B14C-2EF6E4161F2C}" {
          w16 = w10
          w17 = "Side Dishes French Fries"
        }
        frame "{6765C831-A263-4DBD-9830-D56C5C48C4F6}" {
          w16 = w10
          w17 = "Eggs/Desserts Stew Fruits"
        }
        frame "{83F1375F-EB1B-40A9-86B3-DFCD902D1B0C}" {
          w16 = w10
          w17 = "Fish Pan-Fry"
        }
        frame "{9329C04F-A85C-46FD-BC63-1BC3F05D6C9E}" {
          w16 = w10
          w17 = "Meat Pan-Fry"
        }
        frame "{0F0A569D-2FE7-4324-9ED7-5628C82C6893}" {
          w16 = w10
          w17 = "Meat Boil"
        }
        frame "{FAABE3B3-8BF8-4DA9-8CE8-04A2B0C5C3C2}" {
          w16 = w10
          w17 = "Meat Roast"
        }
        frame "{13E4B8B7-FD38-472A-ACD2-FC12B76D113A}" {
          w16 = w10
          w17 = "Baking Products \nSponge Cake"
        }
        frame "{04993A6F-889C-4473-ADAF-7338528AEE75}" {
          w16 = w10
          w17 = "Fish Octopus"
        }
        frame "{19531579-B6F6-4328-8D4E-1325C7F9D944}" {
          w16 = w10
          w17 = "Fish Grill"
        }
        frame "{8123D281-1ABB-47E0-B200-C28308395EAF}" {
          w16 = w10
          w17 = "Poultry Grill"
        }
        frame "{00733775-C3B1-46DA-A60B-DB1D59B82C5A}" {
          w16 = w10
          w17 = "Poultry Breaded"
        }
        frame "{75B3F4B9-9CC0-4F83-9FF9-15F9E9C8A9A4}" {
          w16 = w10
          w17 = "Side Dishes Congee"
        }
        frame "{1787D697-876C-4221-B83E-F0857D1087B3}" {
          w16 = w10
          w17 = "Manual Cooking Mode"
        }
        frame "{395E607C-10B2-45FE-BF3F-BE5E7B6471AD}" {
          w16 = w10
          w17 = "Baking Products Pretzel Products"
        }
        frame "{1A62A06A-87A2-42C3-B2EF-9971E74F3929}" {
          w16 = w10
          w17 = "Baking Products Meringue"
        }
        frame "{E2F5376A-C2A8-4743-9627-579412864232}" {
          w16 = w10
          w17 = "Baking Products Prove"
        }
        frame "{6FE56029-9384-41AD-B0AE-4FA695022704}" {
          w16 = w10
          w17 = "Baking Products Pizza"
        }
        frame "{F69DF94D-725B-4255-931A-9723C2CF3E5C}" {
          w16 = w10
          w17 = "Baking Products \nCookies/Tea Cakes"
        }
        frame "{6D26489F-2AE0-498D-A09F-A25B4D1137F5}" {
          w16 = w10
          w17 = "Baking Products Puff Pastry"
        }
        frame "{DDA27317-309A-4BD0-B3F9-1947256376A8}" {
          w16 = w10
          w17 = "Side Dishes Stew"
        }
        frame "{A65DA19F-1762-45BF-97EA-FACA10377322}" {
          w16 = w10
          w17 = "Side Dishes Dim Sum"
        }
        frame "{56AF2076-5A0D-45F5-9D77-0E09B7723B13}" {
          w16 = w10
          w17 = "Side Dishes Totopos"
        }
        frame "{261C59F7-5CFB-4045-822B-CFA515D46F53}" {
          w16 = w10
          w17 = "Poultry Beijing Duck"
        }
        frame "{6597280D-675C-4E3A-8CA9-B8BCC6691CF0}" {
          w16 = w10
          w17 = "Poultry Braise"
        }
        frame "{74D787BE-BA0E-499E-B1B6-E2B14B609547}" {
          w16 = w10
          w17 = "Poultry Roasted Turkey"
        }
        frame "{519A8745-6A07-4D8B-9ECD-5BF656501BAD}" {
          w16 = w10
          w17 = "Poultry Boil"
        }
        frame "{BD89A298-9ACF-4FD7-8562-5CA878B10BF1}" {
          w16 = w10
          w17 = "Side Dishes Steamed Rice"
        }
        frame "{7CE6A4B9-4132-40D8-AB7D-52D157580038}" {
          w16 = w10
          w17 = "Poultry Roasted Goose"
        }
        frame "{D963DDDE-C8CE-4619-8086-7040BACA12E5}" {
          w16 = w10
          w17 = "Poultry Roasted Chicken"
        }
        frame "{FE5D0805-1112-43D4-86DC-5AA0273FE6C7}" {
          w16 = w10
          w17 = "KeyAccount Wings CS"
        }
        frame "{890DCB28-2C3C-4F2F-A2A1-93BF1E8E006D}" {
          w16 = w10
          w17 = "KeyAccouKeyAccount \nSmart Shaobingnt Wings CS"
        }
        frame "{C97832AA-B2F3-4693-84F6-45456E67855A}" {
          w16 = w10
          w17 = "Baking Products \nNew York Cheesecake"
        }
        frame "{82A0CFFB-7E13-491B-A01C-5FCACDB19348}" {
          w16 = w10
          w17 = "Baking Products \n-leavened cakes"
        }
        frame "{1C2F98C5-CD84-4C79-A15A-24D78A85E254}" {
          w16 = w10
          w17 = "Baking Products \nCheesecake trad."
        }
        frame "{26C392C4-31EF-44D9-9BA8-963BB9B25672}" {
          w16 = w10
          w17 = "Baking Products Muffin"
        }
        frame "{287B5AA8-CF7F-43AA-B74A-776135F18DFD}" {
          w16 = w10
          w17 = "Baking Products \nPao de Queijo"
        }
        frame "{80DD2B6C-F59C-43B1-8252-7081E3CE16C6}" {
          w16 = w10
          w17 = "Baking Products Soft Rolls"
        }
        frame "{32D9AF70-2F58-4DA7-BF8F-30DD0FF0E0C5}" {
          w16 = w10
          w17 = "Baking Products Samosas"
        }
        frame "{2E442CF8-101F-4F1B-9347-EBF903108E7E}" {
          w16 = w10
          w17 = "Side Dishes Fried rice"
        }
        frame "{6A89E9E2-CDDA-44C6-84A5-C888C50411D2}" {
          w16 = w10
          w17 = "Eggs/Desserts \nBake Desserts"
        }
        frame "{36E75EB1-078C-460D-9783-00ED7ADDF0DC}" {
          w16 = w10
          w17 = "Baking Products \nCream Puffs/Éclairs"
        }
        frame "{4EAC3460-D057-4EB4-97CD-9F49E2821417}" {
          w16 = w10
          w17 = "Baking Products Bread"
        }
        frame "{61F346B6-547C-4323-AE16-B7B430FF64A5}" {
          w16 = w10
          w17 = "Baking Products Rolls"
        }
        frame "{BA18F1F8-36E1-49AA-9317-CC8A14609E86}" {
          w16 = w10
          w17 = "Baking Products Croissant"
        }
        frame "{83BC60B4-B32E-43B9-9500-D334B44EC9F0}" {
          w16 = w10
          w17 = "Baking Products Danish"
        }
        frame "{F1FDE193-4694-472F-BFCF-31F5DD46AF5B}" {
          w16 = w10
          w17 = "Baking Products Crisp Up"
        }
        frame "{7CA4EACC-025D-4C57-9C55-0EE85C8B1FBF}" {
          w16 = w10
          w17 = "Poultry Tandoori"
        }
        frame "{60CC90CE-3861-461F-A8AA-04BC1D930505}" {
          w16 = w10
          w17 = "Side Dishes \nSemi-Preserves"
        }
        frame "{9A939EAF-2B92-4EA5-BB05-767687F6963B}" {
          w16 = w10
          w17 = "Poultry Roasted Duck"
        }
        frame "{B56C4B5C-B0C3-47C8-9CD1-59FA53351C6C}" {
          w16 = w10
          w17 = "Side Dishes Pasta in Sauce"
        }
        frame "{EA88672F-F46B-4D50-9E18-4E038DE198DD}" {
          w16 = w10
          w17 = "Side Dishes Dehydrate"
        }
        frame "{A918306D-D5CE-4046-ADB5-77A1A604340E}" {
          w16 = w10
          w17 = "Side Dishes Lentils \nand Legumes"
        }
        frame "{F65C0E46-3CC9-464C-A30E-0CA226A5351C}" {
          w16 = w10
          w17 = "Side Dishes \nMacaroni Casserole"
        }
        frame "{D7E18306-5BC3-426E-9A05-0F3974E06628}" {
          w16 = w10
          w17 = "Side Dishes \nDouble Boiled Soup"
        }
        frame "{9C29F1A7-DEA0-4841-8022-4B38338C2057}" {
          w16 = w10
          w17 = "Eggs/Desserts \nFried Eggs"
        }
        frame "{68F70082-D9AE-4958-B525-15C94503CB30}" {
          w16 = w10
          w17 = "Side Dishes Sushi Rice"
        }
        frame "{442F75F0-F5A5-43E2-AB50-4EDBCC482DF8}" {
          w16 = w10
          w17 = "Eggs/Desserts \nScrambled Eggs"
        }
        frame "{318D6DD8-4370-40C4-9350-2E27CEE4C459}" {
          w16 = w10
          w17 = "Side Dishes Itamemono"
        }
        frame "{FDB248C6-233E-4073-B320-C5EDFA964DDC}" {
          w16 = w10
          w17 = "Side Dishes \nBake/convenience"
        }
        frame "{1FE0C1D9-E983-4A3E-A622-0A20644958E2}" {
          w16 = w10
          w17 = "Side Dishes \nBaked Potatoes"
        }
        frame "{F7E21E3A-BDD9-4540-8308-DCF28808A2E4}" {
          w16 = w10
          w17 = "Side Dishes \nDumplings"
        }
        frame "{B6CC292C-A192-4438-AA03-AD98E36BC99B}" {
          w16 = w10
          w17 = "Eggs/Desserts \nBoiled Eggs"
        }
        frame "{3A8E21E1-1BBD-47FF-BABB-3D8FFDFC396A}" {
          w16 = w10
          w17 = "Finishing Container \nService"
        }
        frame "{63B3B5A7-22D8-44D0-9A0C-E49EDDB11ABF}" {
          w16 = w10
          w17 = "Side Dishes \nDeep-Fry"
        }
        frame "{E5B58BD4-8595-4882-A2EF-9FEB6F9230AD}" {
          w16 = w10
          w17 = "Poultry Steam"
        }
        frame "{C4FA2611-C71B-4A3F-865B-A9770991885C}" {
          w16 = w10
          w17 = "Finishing Heat \nThrough"
        }
        frame "{F1EA8973-33C0-4B60-A5DF-81B90DDF44BC}" {
          w16 = w10
          w17 = "Side Dishes \nSear/Roast"
        }
        frame "{0FF25CEB-CB76-4B31-A600-E17BEB5530FB}" {
          w16 = w10
          w17 = "Poultry Deep-Fry"
        }
        frame "{C66B34BE-FDB7-469C-B20F-A80C5FF6CF88}" {
          w16 = w10
          w17 = "Eggs/Desserts \nOnsen Egg"
        }
        frame "{A90A75EC-69C5-4C4B-938F-ABC1BCD9C17F}" {
          w16 = w10
          w17 = "Eggs/Desserts \nEgg Flan"
        }
        frame "{B57167C5-6876-45BF-8DAD-ACC7339FDAEC}" {
          w16 = w10
          w17 = "Finishing Hold"
        }
        frame "{CE31AF4A-0919-4548-915E-192BF2E4BDD4}" {
          w16 = w10
          w17 = "Poultry Tsukeyaki"
        }
        frame "{CD61B0AB-5C3F-4638-8EA0-BADC67EBF588}" {
          w16 = w10
          w17 = "Poultry Cantonese \nDuck"
        }
        frame "{0A3EF61E-F132-487A-B750-DC4EB64F19AF}" {
          w16 = w10
          w17 = "Fish Sauté"
        }
        frame "{D4807E4F-3881-469F-B827-A33C3A9A0A70}" {
          w16 = w10
          w17 = "Fish Moqueca"
        }
        frame "{F2275F7D-8E8E-46D0-8713-96D46992564C}" {
          w16 = w10
          w17 = "Fish in Salt Crust"
        }
        frame "{09D3A3CD-B9AE-46D3-AB67-B2534D60DF5E}" {
          w16 = w10
          w17 = "Fish Braising \nChinese-Style"
        }
        frame "{1AD8770B-E3A9-40C0-B998-7067C783385D}" {
          w16 = w10
          w17 = "Fish Nizakana"
        }
        frame "{0ABC5CC3-002A-4E0B-BF04-FADB7E839317}" {
          w16 = w10
          w17 = "Fish Tsukeyaki"
        }
        frame "{20BF7842-6B07-4152-A19C-8B2DDEDCE335}" {
          w16 = w10
          w17 = "Fish Deep-Fry"
        }
        frame "{0513BF49-AE8C-4EB1-9FF2-C6E377FCD60A}" {
          w16 = w10
          w17 = "Meat Lomo Saltado"
        }
        frame "{51367A3F-F84C-49AC-9489-6DF50556F0ED}" {
          w16 = w10
          w17 = "Finishing Plated \nBanquet"
        }
        frame "{625A8DB3-AC2F-4A7A-8D3E-7D9A2696735A}" {
          w16 = w10
          w17 = "Meat Boil/Simmer"
        }
        frame "{CBE4B86D-BBF1-460A-9EEB-E2ABDE0233AB}" {
          w16 = w10
          w17 = "Finishing Crust"
        }
        frame "{3390A115-F807-4F33-BE1A-7719FDF85D28}" {
          w16 = w10
          w17 = "Meat Semi-preserves"
        }
        frame "{098F391B-61DF-4A68-B1F5-8AF20E3D178E}" {
          w16 = w10
          w17 = "Meat Meat in Pastry"
        }
        frame "{2A68BA92-FF24-46C8-A856-20AC2EE5549B}" {
          w16 = w10
          w17 = "Meat Deep-Fry"
        }
        frame "{8157F433-1D2A-468D-9638-BD3076C309B1}" {
          w16 = w10
          w17 = "Meat Nikomi"
        }
        frame "{3CAE6FF3-98D3-4F7F-8CAD-91A9A4EB6043}" {
          w16 = w10
          w17 = "Side Dishes \nCasserole"
        }
        frame "{AE7851F5-2BE6-4F5E-937E-A23859908790}" {
          w16 = w10
          w17 = "Meat Roast with Crackling"
        }
        frame "{E2F2409E-A578-4852-9B28-A2B7CC9054E9}" {
          w16 = w10
          w17 = "Meat Cochinita Pibil"
        }
        frame "{CB5FB525-6F3B-4FE7-8554-5355D529E8BE}" {
          w16 = w10
          w17 = "Meat Braised Pork"
        }
        frame "{A7A0EF5A-8BC2-40B8-A983-A12002543E89}" {
          w16 = w10
          w17 = "Meat Braise"
        }
        frame "{ECD27E35-D543-4F81-94BA-D330E08A278B}" {
          w16 = w10
          w17 = "Eggs/Desserts \nSteam Dessert"
        }
        frame "{761DAC1A-EF9A-4AD5-BFAF-823EAFAE0011}" {
          w16 = w10
          w17 = "Meat Low \nTemperature Roast"
        }
        frame "{2D8433BD-96FB-4D85-B94C-75D43C84ABBA}" {
          w16 = w10
          w17 = "Meat Crispy Pork Belly"
        }
        frame "{FA7F6AFE-3D63-444F-A705-01E12B87BAF1}" {
          w16 = w10
          w17 = "Poultry Low \nTemperature Roast"
        }
        frame "{A95B95BE-96E0-4D9C-B6AF-FD19F6EDCD25}" {
          w16 = w10
          w17 = "Baking Products \nEggtart Macau Style"
        }
        frame "{648DF627-A820-4F7A-B79C-197B68CC10F3}" {
          w16 = w10
          w17 = "Finishing Plates \nà la carte"
        }
        frame "{31748A41-0BCE-431A-892C-4578916A888C}" {
          w16 = w10
          w17 = "Baking Products \nBaguette"
        }
        frame "{DF2617BC-B6BA-4B56-B72C-3D0899ACEAC5}" {
          w16 = w10
          w17 = "IPM Basic"
        }
        frame "{7BAD8020-9113-4CF2-9757-92B1A337A905}" {
          w16 = w10
          w17 = "IPM Basic \nCoreTemp-Bon"
        }
        frame "{75D28581-1379-4023-BFF0-CFBAE796C82D}" {
          w16 = w10
          w17 = "IPM Basic \nTime-Bon"
        }
        frame "{56D427CE-4388-4536-AF05-A827EAEF71B5}" {
          w16 = w10
          w17 = "Meat Pasteurize \nmeat"
        }
        frame "{E1E80B51-6A14-42A6-84CB-A25C49878352}" {
          w16 = w10
          w17 = "Poultry pasteurize \npoultry"
        }
        frame "{DE3F34D8-4581-4481-A1F2-D1DC4937705F}" {
          w16 = w10
          w17 = "KeyAccount KFC \nBrazer"
        }
        frame "{682C6FB0-C94A-4484-9B27-E31E0EB134DE}" {
          w16 = w10
          w17 = "Meat Char Siu"
        }
        frame "{D068AFEE-B3C3-4DA4-937A-FC67EBF1D8E7}" {
          w16 = w10
          w17 = "Meat Sautè"
        }
        frame "{B9B1036B-17F1-44CA-8318-C7C4198D9208}" {
          w16 = w10
          w17 = "Fish Steaming Chinese-Style"
        }
        frame "{805FF9C3-8A13-44FE-883B-8EF064C2D6B8}" {
          w16 = w10
          w17 = "Side Dishes Biryani"
        }
        frame "{7D7A7D29-366D-443A-A4EA-83DF823CFECF}" {
          w16 = w10
          w17 = "Key Account Breadrolls CS"
        }
        frame "{FA71B6C4-C74A-43E2-A85E-F5EC83687133}" {
          w16 = w10
          w17 = "Meat Bacon"
        }
        frame "{A6EEE2E6-2212-4E73-BCAC-51A6F6087BC2}" {
          w16 = w10
          w17 = "Eggs/Desserts \nPoached Eggs"
        }
        frame "{F8AA9EC0-86B9-42EE-9DE0-BA9B14B40527}" {
          w16 = w10
          w17 = "Meat Meatloaf"
        }
        frame "{7F5C56DF-E173-4519-8D9B-972D9C402153}" {
          w16 = w10
          w17 = "Meat Kebab"
        }
        frame "{0C494E25-97B4-4A85-B85B-03482032E8BF}" {
          w16 = w10
          w17 = "Fish Braise"
        }
        frame "{CB668B8D-A87B-41BC-8B2F-4D6D24124864}" {
          w16 = w10
          w17 = "Meat Roastbeef Dry"
        }
        frame "{AB81A12D-06D0-45E1-8697-C9EB88ABFC09}" {
          w16 = w10
          w17 = "Meat Tsukeyaki"
        }
        frame "{C6068470-9DCA-4BA6-94C5-5CE4773C1D2F}" {
          w16 = w10
          w17 = "KeyAccount KFC Eggtart"
        }
        frame "{2920903B-EE27-4EEC-AFE4-E0E890892150}" {
          w16 = w10
          w17 = "KeyAccount Eggtart CS"
        }
        frame "{2E704D93-F1EB-45E5-97E6-453FF9B22EB3}" {
          w16 = w10
          w17 = "Eggs/Desserts \nPasteurize Eggs"
        }
        frame "{4844028C-0218-4C9F-94F0-DEFD553D71D3}" {
          w16 = w10
          w17 = "Fish Pasteurize fish"
        }
        frame "{ACD99A57-DC4B-4C72-AAA1-6D6F0477D32F}" {
          w16 = w10
          w17 = "KeyAccount Grilled \nChicken CS"
        }
        frame "{FF94ABEA-5423-496F-A098-51B03E042A3E}" {
          w16 = w10
          w17 = "Key Account Breadrolls \nCS reduced energy"
        }
        frame "{C87FDCA9-4EC4-4CFA-B88E-24C98DC7E064}" {
          w16 = w10
          w17 = "Key Account Test"
        }
        frame "{3C9F4099-030C-4284-AD87-B776E9F1F6AC}" {
          w16 = w10
          w17 = "KeyAccount Testgarpfad "
        }
        frame "{89BBFE1D-6698-44BF-A252-B30A833D9782}" {
          w16 = w10
          w17 = "KeyAccount Cooldown CS"
        }
        frame "{7126B951-324A-4151-BE25-84C55DB4C4B4}" {
          w16 = w10
          w17 = "KeyAccount Croissant CS"
        }
        frame "{BBE7A6F8-5E5D-458D-9C38-9E64A63D5E9E}" {
          w16 = w10
          w17 = "KeyAccount Bacon CS"
        }
        frame "{06B13513-2C59-4BA0-850F-94FEB1E23733}" {
          w16 = w10
          w17 = "KeyAccount Eggs CS"
        }
        frame "{7EAD10B0-C927-42A2-A8E7-F5699FEC35BA}" {
          w16 = w10
          w17 = "IPM Basic Timer-Bon"
        }
        frame "{FE51FE95-5197-4765-A51F-58F010E7A1EF}" {
          w16 = w10
          w17 = "KeyAccount Braising CS"
        }
        frame "{77C9C145-9C3F-4F21-BD04-CC3A4C793083}" {
          w16 = w10
          w17 = "KeyAccount Container \nFinishing CS"
        }
        frame "{91B94D04-528D-4887-A545-59C27CD008C2}" {
          w16 = w10
          w17 = "KeyAccount Baguette CS"
        }
        frame "{D915C06C-6580-43C2-A585-861B96FACB5C}" {
          w16 = w10
          w17 = "KeyAccount Baguette CS"
        }
        frame "{AEFD1BCE-65E7-4780-ABA9-F82096F188BA}" {
          w16 = w10
          w17 = "Smoked Products Hot \nSmoking Side Dishes"
        }
        frame "{43C62C0F-C866-4950-B655-D8E0886B1469}" {
          w16 = w10
          w17 = "Smoked Products \nHot Smoking Fish"
        }
        frame "{F46C774C-7D60-4C85-BCA1-1CB209AFAFD7}" {
          w16 = w10
          w17 = "Smoked Products \nHot Smoking Turkey"
        }
        frame "{ACC5B8EB-134F-4552-9573-EC2BE2E5117E}" {
          w16 = w10
          w17 = "Smoked Products \nLow Temperature Smoking"
        }
        frame "{79FF9149-0184-42B7-865B-5CAADCFC80F8}" {
          w16 = w10
          w17 = "Smoked Products \nBraise & Smoking"
        }
        frame "{A2F9E0F0-F68C-4F24-9E9A-07808C234D2C}" {
          w16 = w10
          w17 = "Smoked Products \nHot Smoking Poultry"
        }
        frame "{9073100C-78C5-42D9-A548-C567D3CD9B14}" {
          w16 = w10
          w17 = "Smoked Products \nSmoking"
        }
        frame "{7D663AFF-7700-4CF6-99F7-58C95F5ECBC5}" {
          w16 = w10
          w17 = "KeyAccount CS 1"
        }
        frame "{D5FAD021-88A9-4FF1-AD3A-F45C92F35DBE}" {
          w16 = w10
          w17 = "KeyAccount CS 2"
        }
        frame "{0E74BD7F-2EEA-41C9-8504-73EF8FACF9EC}" {
          w16 = w10
          w17 = "KeyAccount CS 3"
        }
        frame "{43530B65-035C-4416-9E09-C89AAD6B3138}" {
          w16 = w10
          w17 = "KeyAccount CS 4"
        }
        frame "{060BB8B3-93E4-4C0A-903F-049C8F10881E}" {
          w16 = w10
          w17 = "KeyAccount CS 5"
        }
        frame "{5BE96088-65A1-4B30-B35B-C9F2B163BDAF}" {
          w16 = w10
          w17 = "KeyAccount CS 6"
        }
        frame "{D63CD06D-0055-45D1-8F4B-A4E1C8E8016C}" {
          w16 = w10
          w17 = "KeyAccount CS 1"
        }
        frame "{EE9325F0-FFA5-49E0-A303-46D2C79450BD}" {
          w16 = w10
          w17 = "KeyAccount CS 2"
        }
        frame "{8865FB7C-25EA-4CC1-ABAE-2217A9732E62}" {
          w16 = w10
          w17 = "KeyAccount CS 3"
        }
        frame "{66E3838B-5A9C-4D8B-8813-583CABC71269}" {
          w16 = w10
          w17 = "KeyAccount CS 4"
        }
        frame "{2F66E9B0-9D0E-4EE8-A5CF-739BA5DC817D}" {
          w16 = w10
          w17 = "KeyAccount CS 5"
        }
        frame "{A69A5C4E-F07D-4514-B69B-1A95CB1B4F19}" {
          w16 = w10
          w17 = "KeyAccount CS 6"
        }
        frame "{1B6024C6-1634-4C17-9835-9587375E7406}" {
          w16 = w10
          w17 = "Fish Grill Japanese-Style"
        }
        frame "{3D4778FE-8D59-4C49-BB38-60C55157653C}" {
          w16 = w10
          w17 = "KeyAccount Roasting CS"
        }
        frame "{324F7ED5-256F-4AE1-A0C9-2C63D0F969DD}" {
          w16 = w10
          w17 = "KeyAccount KFC \nSmart Solution Dummy"
        }
        frame "{0F018597-23CE-418D-956E-97A50E81981E}" {
          w16 = w10
          w17 = "KeyAccount \nSmart Beef rolls"
        }
        frame "{5A4C7461-0293-4FE8-B06C-92014ACC1AA0}" {
          w16 = w10
          w17 = "KeyAccount \nSmart Wings"
        }
        frame "{A97DAA61-80DF-40A8-B5F4-06B9A61CA926}" {
          w16 = w10
          w17 = "KeyAccount \nSmart Big Legs"
        }
        frame "{69E9FFF2-B77F-4246-96B5-22C69D6373C5}" {
          w16 = w10
          w17 = "KeyAccount \nSmart Eggtart"
        }
        frame "{761ED2A8-774B-471A-90D6-79AD47F07822}" {
          w16 = w10
          w17 = "KeyAccount Smart \nRoast Chicken with Rice"
        }
        frame "{42528894-076B-4FE3-B66F-E2FC8C08D30D}" {
          w16 = w10
          w17 = "KeyAccount Smart \nReheat Croissant"
        }
        frame "{A6300352-318A-481A-BB36-27BACFEE6697}" {
          w16 = w10
          w17 = "KeyAccount \nSmart Skewers"
        }
        frame "{52C8FD3F-40E4-4C30-89B7-CAAF3E8513D8}" {
          w16 = w10
          w17 = "KeyAccount Smart \nBeef Patty"
        }
        frame "{237BE43F-F593-4C7A-91AF-1CDA720F24B6}" {
          w16 = w10
          w17 = "KeyAccount Smart \nChicken Patty"
        }
        frame "{E676C7EF-0ADE-48C0-82C5-6318A1C758BC}" {
          w16 = w10
          w17 = "KeyAccount Smart \nBacon Omelet"
        }
        frame "{68D23A31-95F2-4FFE-947A-64C7906BEE6D}" {
          w16 = w10
          w17 = "KeyAccount Smart \n1h Congee"
        }
        frame "{87C1ED0C-9A53-401F-8638-E394F5220A9A}" {
          w16 = w10
          w17 = "KeyAccount Smart \n1h Sticky Rice"
        }
        frame "{44867B46-949C-43C3-BC8D-50256AB3A86B}" {
          w16 = w10
          w17 = "KeyAccount Smart \nOvernight Congee"
        }
        frame "{BDBB1EFC-EBF3-4A0C-8C27-D6E74B28330C}" {
          w16 = w10
          w17 = "KeyAccount Smart \nOvernight Sticky Rice"
        }
        frame "{67354A02-E290-49F7-865A-E64454D62B3A}" {
          w16 = w10
          w17 = "KeyAccount Smart \nSoy Milk"
        }
        frame "{4A05B90C-9D82-453C-8E15-26FA3DFFE321}" {
          w16 = w10
          w17 = "KeyAccount \nSmart Eggs"
        }
        frame "{6FF7095A-328F-4273-9F13-21020661EF21}" {
          w16 = w10
          w17 = "Finishing Pasteurize \ncontainer"
        }
        frame "{969E2B63-B7D4-49C6-95E4-B79C14A18654}" {
          w16 = w10
          w17 = "KeyAccount Plated \nItems CS"
        }
        frame "{AD77E3B7-963B-4325-8B0C-568D70A33682}" {
          w16 = w10
          w17 = "KeyAccount Smart \niPM Steam "
        }
        frame "{9747C72E-2EF9-453C-984A-0C504E48A35A}" {
          w16 = w10
          w17 = "KeyAccount Smart \niPM Combi"
        }
        frame "{22B8E221-0A2C-4542-916D-2FD2BD9FC135}" {
          w16 = w10
          w17 = "Baking Products \nPanettone / Colomba"
        }
        frame "{D2FB3F03-122A-4DBF-902C-EF21DED4AD3D}" {
          w16 = w10
          w17 = "KeyAccount Steamed Rice CS "
        }
        frame "{A56F8250-8D88-482A-8ECD-EB809DE76D09}" {
          w16 = w10
          w17 = "KeyAccount Roasting CS"
        }
        frame "{56EF4442-B273-4281-9DFD-59E2437690FD}" {
          w16 = w10
          w17 = "Side Dishes Wok fry"
        }
        frame "{0CF97978-A390-4F5E-984C-3C2191CCF0AB}" {
          w16 = w10
          w17 = "Side Dishes Yoghurt"
        }
        frame "{DDAD2B9A-AE60-44F1-9C1E-27F51ACDD114}" {
          w16 = w10
          w17 = "Baking Products \nMooncake Su Style"
        }
        frame "{2841ED07-8001-462E-87E8-4A3EE01469BD}" {
          w16 = w10
          w17 = "Side Dishes Sauté"
        }
        frame "{80B7AF0E-94A7-470F-BB04-AAFC33803E56}" {
          w16 = w10
          w17 = "Baking Products Soft \nbread european style (CHN)"
        }
        frame "{CB958889-3EF8-493B-B74A-1AD3BB9FE4B0}" {
          w16 = w10
          w17 = "KeyAccount Smart \nSmall Beef Patty "
        }
        frame "{58AA74EC-ED87-4988-807B-88B793B8F02B}" {
          w16 = w10
          w17 = "KeyAccount Smart \nFlower Pastry "
        }
        frame "{02658C61-2DDD-4561-9FB6-887557B15A1B}" {
          w16 = w10
          w17 = "KeyAccount Smart \nLamb Skewer"
        }
        frame "{A0386F6E-A5A1-4B34-B5E6-052CD8D2C6FF}" {
          w16 = w10
          w17 = "KeyAccount Smart \nCrispy Wings"
        }
        frame "{EF6C3896-B3D5-4F3B-9815-337EDBC90CE2}" {
          w16 = w10
          w17 = "KeyAccount Smart \nSteam Bun "
        }
        frame "{7BCDAA56-23EE-473F-9A1B-A9AC3816E32B}" {
          w16 = w10
          w17 = "KeyAccount Smart \nMoon Cake "
        }
        frame "{84A9753A-7DCB-463F-9A4C-899E961F18F5}" {
          w16 = w10
          w17 = "KeyAccount Smart \nCheese Omelete"
        }
        frame "{66851CA1-68FF-4FFC-80AB-51B1013C57BA}" {
          w16 = w10
          w17 = "KeyAccount Smart 575 \nSteam Chicken"
        }
        frame "{B62CC094-7855-456F-B899-AE6D386526AA}" {
          w16 = w10
          w17 = "KeyAccount Smart \n725 Steam Chicken "
        }
        frame "{1CFD61BF-1820-4E20-AD8A-4CF1D8A4049C}" {
          w16 = w10
          w17 = "Meat Black Char Siu"
        }
        frame "{7FD22927-6DAF-4FA9-800C-2771F6CFB212}" {
          w16 = w10
          w17 = "KeyAccount Smart \niPM HotAir "
        }
        frame "{A222B867-D81A-4DDD-9255-E329D589F46F}" {
          w16 = w10
          w17 = "KeyAccount Smart \n60g Beef Patty"
        }
        frame "{C5E346E6-AEC1-416D-AAAD-D688D1265623}" {
          w16 = w10
          w17 = "KeyAccount Smart CS001"
        }
        frame "{39EBFDBD-12EE-43D0-9117-2895DCCD140C}" {
          w16 = w10
          w17 = "KeyAccount Smart CS002"
        }
        frame "{C46BDB03-3A85-4771-9422-8F1360F68524}" {
          w16 = w10
          w17 = "KeyAccount Smart CS003"
        }
        frame "{382A254C-FFDC-4C40-9760-2EE48760809B}" {
          w16 = w10
          w17 = "KeyAccount Smart CS004"
        }
        frame "{6C758135-4DE1-4000-9CE1-E727FD6EEBC9}" {
          w16 = w10
          w17 = "KeyAccount Smart CS005"
        }
        frame "{770B0FB1-FB15-4791-B3FE-E1D707FBB6FA}" {
          w16 = w10
          w17 = "KeyAccount Smart CS006"
        }
        frame "{0DACDD33-14BD-416D-A411-D4D69FCC796F}" {
          w16 = w10
          w17 = "KeyAccount Smart CS007"
        }
        frame "{564979F9-FA0A-4455-954F-096B3A2668F1}" {
          w16 = w10
          w17 = "KeyAccount Smart CS008"
        }
        frame "{F5A79429-AFAE-4051-8F3A-1A5FB823A13D}" {
          w16 = w10
          w17 = "KeyAccount Smart CS010"
        }
        frame "{4794ABFE-7D5B-4952-A545-4E4A33779844}" {
          w16 = w10
          w17 = "KeyAccount Smart CS011"
        }
        frame "{2BE9396A-C73B-4A89-B093-1B95D8F71AA6}" {
          w16 = w10
          w17 = "KeyAccount Smart CS012"
        }
        frame "{5D703266-3B93-423D-A09C-62FCBFE6FB34}" {
          w16 = w10
          w17 = "KeyAccount Smart CS013"
        }
        frame "{2B1FABB2-ACCC-49BE-9E8A-6779BDA5AFC7}" {
          w16 = w10
          w17 = "KeyAccount Smart CS014"
        }
        frame "{7466AAFC-F967-4786-9B50-1E3AC8DF0F0E}" {
          w16 = w10
          w17 = "KeyAccount Smart CS015"
        }
        frame "{F3333BE8-1001-45ED-9522-D3116323BCBE}" {
          w16 = w10
          w17 = "KeyAccount Smart CS016"
        }
        frame "{5F499458-AC78-4F44-A860-83111EDEC201}" {
          w16 = w10
          w17 = "KeyAccount Smart CS017"
        }
        frame "{2E3B4429-D515-404C-85A4-7ACB4BAB8E8A}" {
          w16 = w10
          w17 = "KeyAccount Smart CS018"
        }
        frame "{E5DE9826-A91B-43BC-9E8F-4ADF800CAC7F}" {
          w16 = w10
          w17 = "KeyAccount Smart CS019"
        }
        frame "{94E6AF2F-6FDD-4D9C-8F90-7ED038B398E3}" {
          w16 = w10
          w17 = "KeyAccount Smart CS020"
        }
        frame "{CF6A8F8F-965D-4D7C-BCB1-C182E3733153}" {
          w16 = w10
          w17 = "KeyAccount Smart CS021"
        }
        frame "{9CEF3C3B-C34D-4B84-8ADF-C292330AA301}" {
          w16 = w10
          w17 = "KeyAccount Smart CS022"
        }
        frame "{0D9DEEED-6D01-4D2A-AF46-A09623751701}" {
          w16 = w10
          w17 = "KeyAccount Smart CS023"
        }
        frame "{BCB68934-8A87-4BA4-BF69-7D3B06A9BE11}" {
          w16 = w10
          w17 = "KeyAccount Smart CS024"
        }
        frame "{1DEF4C57-DA6E-44AC-B897-9BE1F049F1A6}" {
          w16 = w10
          w17 = "KeyAccount Smart CS025"
        }
        frame "{C4998270-1B48-4B66-B23A-159C21C2C8C0}" {
          w16 = w10
          w17 = "KeyAccount Smart CS026"
        }
        frame "{3C44FE72-6022-4830-B1BC-32B9C6E16C14}" {
          w16 = w10
          w17 = "KeyAccount Smart CS027"
        }
        frame "{62B03782-ECB3-4D43-BCCA-0FF14031501B}" {
          w16 = w10
          w17 = "KeyAccount Smart CS028"
        }
        frame "{2442CA8B-57E0-4726-B56B-559C71D3422E}" {
          w16 = w10
          w17 = "KeyAccount Smart CS029"
        }
        frame "{84AF6FAB-8A93-4278-8BD9-CB62ED23A0C6}" {
          w16 = w10
          w17 = "KeyAccount Smart CS030"
        }
        frame "{9D2AB5F4-91CF-48B0-B398-AD3EA5C4BC7E}" {
          w16 = w10
          w17 = "KeyAccount Smart CS009"
        }
        frame "{6E7D228A-4CFE-4291-AAB6-552B15B6821B}" {
          w16 = w10
          w17 = "Finishing Pasteurize \nconvenience"
        }
        frame "{BE103E27-8215-4B6A-8482-24480F2EED6C}" {
          w16 = w10
          w17 = "Poultry Crispy \nChicken China"
        }
        frame "{E89AD1F9-1EE3-40FA-B78B-B0CC15D26ADA}" {
          w16 = w10
          w17 = "Finishing a la \ncarte steam"
        }
        frame "{12D237B0-C07B-42E2-8255-DC08A9CEB752}" {
          w16 = w10
          w17 = "Finishing a la \ncarte panfry"
        }
        frame "{7693ADC5-FAB3-4360-88A8-9DA20F847225}" {
          w16 = w10
          w17 = "Finishing a la \ncarte grilling"
        }
        frame "{90985A96-0B20-42F0-8D57-3ACFA97AFC9D}" {
          w16 = w10
          w17 = "Finishing a la \ncarte baking"
        }
        frame "{4AF7C577-D270-48C4-9B46-22667ED9D313}" {
          w16 = w10
          w17 = "Side Dishes \nQuick Oven Fries"
        }
        frame "{75234359-3F1B-4619-A787-F8E29E2C0042}" {
          w16 = w10
          w17 = "Baking Products \nCantonese Mooncake"
        }
        frame "{16DC5F46-66DF-4E78-A082-F9FD7901DFD5}" {
          w16 = w10
          w17 = "Sous-Vide Fish"
        }
        frame "{E462B3D4-3FCD-4ED5-9B8D-CAEC3C87C5CA}" {
          w16 = w10
          w17 = "Sous-Vide \nSide Dishes"
        }
        frame "{C76A54C2-4A9D-47F6-BA58-D80734854623}" {
          w16 = w10
          w17 = "Sous-Vide \nPoultry"
        }
        frame "{24E2AB5F-6ED4-4443-9CFA-75C4E6654CA3}" {
          w16 = w10
          w17 = "Sous-Vide Meat"
        }
        frame "{7B6C937F-EAA7-4307-9494-220119C1B542}" {
          w16 = w10
          w17 = "Dauerlauf MW \nKT 100% Feuchte"
        }
        frame "{1A01E00E-FFBC-4C5E-8C61-B4ABF1EBB668}" {
          w16 = w10
          w17 = "Finishing a la \ncarte sauté"
        }
        frame "{48E61BE2-9CCA-48DA-B435-6F58307351C7}" {
          w16 = w10
          w17 = "Baking Products \nChinese Soft Bread"
        }
        frame "{75AFE0AD-7FE5-476F-BC2F-E81C52A3B6C1}" {
          w16 = w10
          w17 = "KeyAccount \nBraising 2 CS"
        }
        frame "{907B0483-E09E-47C6-A729-54E69F43C43A}" {
          w16 = w10
          w17 = "Finishing a la \ncarte service"
        }
        frame "{E511BB01-975B-43D5-A457-9FC1B04A3C10}" {
          w16 = w10
          w17 = "KeyAccount \nSteam Loop"
        }
        frame "{E7C1E817-4544-48B8-AB38-BB2854FB4311}" {
          w16 = w10
          w17 = "KeyAccount \nRoasting CS 2"
        }
        frame "{3B4AC9E4-4179-4AEE-81B7-ED555BA6DA6A}" {
          w16 = w10
          w17 = "Meat Suckling pig"
        }
        frame "{4B00C2F5-7B3C-4710-8F12-852C044AAC3D}" {
          w16 = w10
          w17 = "KeyAccount \nBraising short CS"
        }
      }
      w15 = "Operating mode / \nCooking process"
    }
    frame "592" {
      case (w14) {
        frame "False", Default {
          w16 = w10
          w17 = "not found"
        }
        frame "{CBA589DD-96CD-402A-96AC-5BFF7D114EBA}" {
          w16 = w10
          w17 = "Light without steam \ngenerator descaling"
        }
        frame "{66C96C8E-B391-417B-A6C9-DA20EDCCFAEA}" {
          w16 = w10
          w17 = "Light with steam \ngenerator descaling"
        }
        frame "{25BD9CAA-E37F-44C2-87C2-56C327C622FD}" {
          w16 = w10
          w17 = "Light eco without steam \ngenerator descaling"
        }
        frame "{332078E2-D710-4D65-A529-2175C4359A6F}" {
          w16 = w10
          w17 = "Light eco with steam \ngenerator descaling"
        }
        frame "{738E0E75-020D-49D1-9852-54C9DCF67051}" {
          w16 = w10
          w17 = "Medium without steam \ngenerator descaling"
        }
        frame "{DACC4655-7A92-41E0-96A7-A283E5BD1AEE}" {
          w16 = w10
          w17 = "Medium with steam \ngenerator descaling"
        }
        frame "{82CEFD0A-43C8-4F39-BA40-CD7BB0232FA4}" {
          w16 = w10
          w17 = "Medium eco without \nsteam generator descaling"
        }
        frame "{DBC24574-DDCC-4FC3-A778-2AB93AF8AFEA}" {
          w16 = w10
          w17 = "Medium eco with \nsteam generator descaling"
        }
        frame "{887397A1-94D5-4B95-B1F8-EA161F861245}" {
          w16 = w10
          w17 = "Strong without steam \ngenerator descaling"
        }
        frame "{B5275CEB-3D2C-4919-A6E8-45317A409630}" {
          w16 = w10
          w17 = "Strong with steam \ngenerator descaling"
        }
        frame "{203FE8F6-9995-40DE-BDAB-6D5CB377BF6A}" {
          w16 = w10
          w17 = "Strong eco without steam \ngenerator descaling"
        }
        frame "{315B87B6-C01A-4D6D-B8C2-0527ED177727}" {
          w16 = w10
          w17 = "Strong eco with steam \ngenerator descaling"
        }
        frame "{65E2919B-5C42-4820-BC98-33F63AFDD3F0}" {
          w16 = w10
          w17 = "Interim cleaning without \nsteam generator descaling"
        }
        frame "{D29BE15A-B3B6-4244-8E0E-44A7DFD9B520}" {
          w16 = w10
          w17 = "Rinse without steam \ngenerator descaling"
        }
        frame "{3C95817D-14FB-4BAD-A002-DB4D22F0E0AA}" {
          w16 = w10
          w17 = "Rinse with steam generator \ndescaling (auto dose)"
        }
        frame "{F96FB4D2-17FC-4704-848B-4AABE8F8C820}" {
          w16 = w10
          w17 = "Rinse without tabs (auto dose)"
        }
        frame "{B72345AA-C872-403A-B567-E1ADF63A5081}" {
          w18 = "Without drying phase Light \nwithout steam generator descaling"
          w16 = w10
          w17 = w18
        }
        frame "{C18D2A4A-4547-4E43-865A-3FC6E833092C}" {
          w19 = "Without drying phase Light \nwith steam generator descaling"
          w16 = w10
          w17 = w19
        }
        frame "{492F451C-0B93-47C3-BC36-AFCB8A228D7C}" {
          w20 = "Without drying phase strong \nwithout steam generator descaling"
          w16 = w10
          w17 = w20
        }
        frame "{724E55F3-E6D1-4D29-8B39-625418C3CCA8}" {
          w21 = "Without drying phase strong \nwith steam generator descaling"
          w16 = w10
          w17 = w21
        }
        frame "{99C7BB81-A9DC-48CB-A479-9A9980AA71FA}" {
          w16 = w10
          w17 = "NDG interim cleaning without \nsteam generator descaling"
        }
        frame "{1C2F9924-D80E-4CA8-A56B-78642B236FAF}" {
          w22 = "Without drying phase strong eco \nwithout steam generator descaling"
          w16 = w10
          w17 = w22
        }
        frame "{5B6F3441-978A-489D-AE9B-5B3699863351}" {
          w23 = "Without drying phase strong eco \nwith steam generator descaling"
          w16 = w10
          w17 = w23
        }
        frame "{7473F324-AC8E-4C8C-A738-1E07FDA8E109}" {
          w16 = w10
          w17 = "NDG strong with steam \ngenerator descaling"
        }
        frame "{0A0807EE-C625-4815-80F7-A4B4AE974899}" {
          w16 = w10
          w17 = "NDG strong without \nsteam generator descaling"
        }
        frame "{38739E20-1D61-4BDC-BCDA-1AA25A40F2FE}" {
          w24 = "Interim cleaning without steam \ngenerator descaling (auto dose)"
          w16 = w10
          w17 = w24
        }
        frame "{B5DCEC69-E9DF-4C25-A8FF-8496D332501C}" {
          w16 = w10
          w17 = "Light eco without steam \ngenerator descaling (Baking)"
        }
        frame "{12712E54-B744-46B8-A141-0A81B64D7011}" {
          w16 = w10
          w17 = "Light with steam generator \ndescaling (Baking)"
        }
        frame "{025AA6D1-C3F2-4E90-A4D6-F1917D171C6E}" {
          w16 = w10
          w17 = "Light eco without steam \ngenerator descaling (Baking)"
        }
        frame "{F7624E50-66B4-4421-80C7-46480577468E}" {
          w16 = w10
          w17 = "Light eco with steam \ngenerator descaling (Baking)"
        }
        frame "{EE769139-367E-4C52-8814-3C9C61866BF7}" {
          w16 = w10
          w17 = "Light Express without \nsteam generator descaling"
        }
        frame "{29F8F17A-F2E8-4143-BE93-B4A6018D43E5}" {
          w16 = w10
          w17 = "Light Express with steam \ngenerator descaling"
        }
        frame "{5FE207E0-2372-4082-BD08-AB9AA60799E7}" {
          w16 = w10
          w17 = "Light without steam generator \ndescaling (auto dose)"
        }
        frame "{43F7F290-F5CA-4E32-8D7F-205CEAC7ED7E}" {
          w16 = w10
          w17 = "Light with steam generator \ndescaling (auto dose)"
        }
        frame "{4E9B4379-26D1-43CB-A99B-8FF396892B4D}" {
          w16 = w10
          w17 = "Rinse with steam \ngenerator descaling"
        }
        frame "{B9BFE4E2-E953-46C2-9FD7-AE4A8E11CD13}" {
          w16 = w10
          w17 = "Rinse without steam \ngenerator descaling (auto dose)"
        }
        frame "{57D3BF39-11B3-4760-8300-3ADE7944D77D}" {
          w16 = w10
          w17 = "Rinse without tabs"
        }
        frame "{E30D7068-41F6-40A7-A10F-A2B3644B2FE3}" {
          w25 = "Interim cleaning without steam \ngenerator descaling (auto dose)"
          w16 = w10
          w17 = w25
        }
        frame "{6671DBEB-BB70-48F9-A93C-CAE76BA47A87}" {
          w16 = w10
          w17 = "Strong eco with steam \ngenerator descaling (auto dose)"
        }
        frame "{B4CD2665-EE21-4E45-881E-CD434890B0A2}" {
          w16 = w10
          w17 = "Strong eco without steam \ngenerator descaling (auto dose)"
        }
        frame "{318D64C3-C5DA-4D03-9BB6-0479A6F40CCC}" {
          w16 = w10
          w17 = "Strong with steam generator \ndescaling (auto dose)"
        }
        frame "{574CCD29-FFFD-4003-83C9-8AC080532669}" {
          w16 = w10
          w17 = "Strong without steam generator \ndescaling (auto dose)"
        }
        frame "{FE4CB1DD-2B30-4295-A957-128BC69272F0}" {
          w16 = w10
          w17 = "Medium eco with steam \ngenerator descaling (auto dose)"
        }
        frame "{F1DBF74B-F189-423B-A0EF-4BE4F8B88896}" {
          w16 = w10
          w17 = "Medium eco without steam \ngenerator descaling (auto dose)"
        }
        frame "{FC5886DA-E94D-4FED-B001-430247AE11C1}" {
          w16 = w10
          w17 = "Medium with steam \ngenerator descaling (auto dose)"
        }
        frame "{C3157636-9CB5-4153-8B02-D9BC6D63F4D2}" {
          w16 = w10
          w17 = "Medium without steam \ngenerator descaling (auto dose)"
        }
        frame "{2A43CD70-B0C1-41A7-959B-99EFD232E764}" {
          w16 = w10
          w17 = "Light eco with steam \ngenerator descaling (auto dose)"
        }
        frame "{D1C7A2CE-5708-4454-889B-C1125FD83297}" {
          w16 = w10
          w17 = "Light eco without steam \ngenerator descaling (auto dose)"
        }
        frame "{42A6A575-6469-4043-9241-D5FA45B7DF87}" {
          w26 = "Without drying phase strong eco \nwith steam generator descaling (auto dose)"
          w16 = w10
          w17 = w26
        }
        frame "{AFF7E7C1-FE23-46DF-B537-182E5AC4E2EA}" {
          w27 = "Without drying phase strong eco without \nsteam generator descaling (auto dose)"
          w16 = w10
          w17 = w27
        }
        frame "{44B79862-E680-462F-897C-3BA26E314C79}" {
          w28 = "Without drying phase strong with \nsteam generator descaling (auto dose)"
          w16 = w10
          w17 = w28
        }
        frame "{8F9272A2-7BC0-46A4-8A8C-CFB81E294D88}" {
          w29 = "Without drying phase strong without \nsteam generator descaling (auto dose)"
          w16 = w10
          w17 = w29
        }
        frame "{AB1098CC-4227-411B-BF9D-017D11705A06}" {
          w30 = "Without drying phase light with \nsteam generator descaling (auto dose)"
          w16 = w10
          w17 = w30
        }
        frame "{5D09A017-0BAC-4CFC-8ABA-BEA1BF918B49}" {
          w31 = "Without drying phase light without \nsteam generator descaling (auto dose)"
          w16 = w10
          w17 = w31
        }
        frame "{F41A1B99-DA3B-4760-9EC1-451A0417D29F}" {
          w16 = w10
          w17 = "Light Express with steam \ngenerator descaling (auto dose)"
        }
        frame "{1B085774-3E4F-4FE8-8149-1FD7C2C5786A}" {
          w32 = "Light Express without steam \ngenerator descaling (auto dose)"
          w16 = w10
          w17 = w32
        }
        frame "{224F9D8B-6031-4194-8209-90E725DA55D1}" {
          w16 = w10
          w17 = "Medium Express"
        }
        frame "{F3F5C49B-0873-48F9-884E-6375C9FA875B}" {
          w33 = "Thermo oxidative cleaning \nwithout steam generator descaling"
          w16 = w10
          w17 = w33
        }
        frame "{CB225C78-3F87-4E9F-9822-A3CB2671AA6C}" {
          w16 = w10
          w17 = "Thermo oxidative cleaning \nwith steam generator descaling"
        }
        frame "{7A2304A9-6CF1-44F1-B9CA-C835D12420B1}" {
          w16 = w10
          w17 = "Test Reciepe: \nStrong eco without SG-descaling."
        }
      }
      w15 = "Cleaning"
    }
    frame "654" {
      w15 = "Cleaning"
      w16 = w10
      w17 = "Emergency clean"
    }
    frame "943", "944", "945", "956" {
      w15 = "Cleaning"
      w16 = w10
      w17 = "CleanSpecial"
    }
    frame "971" {
      w15 = "Service"
      w16 = w10
      w17 = "Flue gas analysis"
    }
    frame "1038" {
      w15 = "Service"
      w16 = w10
      w17 = "Selftest"
    }
    frame "1095" {
      w15 = "ORDER_NAME_FROM_MMI"
      w16 = w10
      w17 = "ORDER_NAME_FROM_MMI"
    }
    frame "1174" {
      w15 = "Service"
      w16 = w10
      w17 = "Modultest iCareSystem"
    }
    frame "1225" {
      w15 = "Service"
      w16 = w10
      w17 = "Module test steam"
    }
    frame "1273" {
      w15 = "Service"
      w16 = w10
      w17 = "Calibration"
    }
    frame "1477" {
      w15 = "Service"
      w16 = w10
      w17 = "iCareSystem reset"
    }
    frame "1541" {
      w15 = "Service"
      w16 = w10
      w17 = "Threshold determination"
    }
    frame "1545" {
      w15 = "Service"
      w16 = w10
      w17 = "Leakage test"
    }
    frame "1546" {
      w15 = "Service"
      w16 = w10
      w17 = "Functional test magnetron"
    }
    frame "1674" {
      w15 = "Service"
      w16 = w10
      w17 = "Module test AutoDose"
    }
    frame "1451" {
      w15 = "Service"
      w16 = w10
      w17 = "Reset reference volume"
    }
    frame "1452" {
      w15 = "Service"
      w16 = w10
      w17 = "Reset current \nfill volume"
    }
    frame "1461" {
      w15 = "Service"
      w16 = w10
      w17 = "Module test \nrecirculation pump"
    }
    frame "1727" {
      w15 = "Service"
      w16 = w10
      w17 = "Empty steam \ngenerator"
    }
    frame "1823" {
      w15 = "Service"
      w16 = w10
      w17 = "GassystemReset"
    }
    frame "2456" {
      w15 = "Service"
      w16 = w10
      w17 = "Modultest Magnetventile"
    }
    frame "4823" {
      w15 = "IPM"
      w16 = w10
      w17 = "IPM"
    }
  }
  $"Rezept name" <- w15
  call "Trim Whitespace.gvi"(string=s1) -> (trimmed string=w34)
  call "Trim Whitespace.gvi"(string=s4) -> (trimmed string=w35)
  call "Trim Whitespace.gvi"(string=s3) -> (trimmed string=w36)
  call "Trim Whitespace.gvi"(string=s2) -> (trimmed string=w37)
  Property Node(instance in=T2 {all zero or empty}, "Device type:"=w34, "Serial number:"=w35, "Start date:"=w36, "Charge number:"=w13, "Prozess-Typ:"=w15, "Cooking programme name:"=w17, "Energy consumption:"=$"Energy consumption:", "Software version:"=w37) -> (instance out=w38)
  $Specifications <- w38
  $"Start date" <- s3
  $"Serial number" <- s4
  $"Device Type" <- s1
  $"Charge nr" <- w13
  $"Error out" <- w16
  $GUID <- w14
  # Cleaning:
  # {3C95817D-14FB-4BAD-A002-DB4D22F0E0AA}, {4E9B4379-26D1-43CB-A99B-8FF396892B4D}, {B9BFE4E2-E953-46C2-9FD7-AE4A8E11CD13}, {D29BE15A-B3B6-4244-8E0E-44A7DFD9B520}, {57D3BF39-11B3-4760-8300-3ADE7944D77D}, {F96FB4D2-17FC-4704-848B-4AABE8F8C820}, {E30D7068-41F6-40A7-A10F-A2B364482FE3}, {65E2919B-5C42-4820-BC98-33F63AFDD3F0}, {42A6A575-6469-4043-9241-D5FA45B7DF87}, {6671DBEB-BB70-48F9-A93C-CAE76BA47A87}, {315B87B6-C01A-4D6D-B8C2-0527ED 177727}, {AFF7E7C1-FE23-46DF-B537-182E5AC4E2EA}, {B4CD2665-EE21-4E45-881E-CD434890B0A2}, {203FE8F6-9995-40DE-BDAB-6D5CB377BF6A},
  # {44879862-E680-462F-897C-3BA26E314C79}, {318D64C3-C5DA-4D03-9BB6-0479A6F40CCC}, {B5275CEB-3D2C-4919-A6E8-45317A409630}, {8F9272A2-7BC0-46A4-8A8C-CFB81E294D88}, {574CCD29-FFFD-4003-83C9-8AC080532669}, {F3F5C49B-0873-48F9-884E-6375C9FA875B}, {887397A1-94D5-4895-B1F8-EA 161F861245}, {FE4CB1DD-2B30-4295-A957-128BC69272F0}, {DBC24574-DDCC-4FC3-A778-2AB93AF8AFEA}, {F1DBF74B-F189-423B-A0EF-4BE4F8B88896}, {82CEFD0A-43C8-4F39-BA40-CD7BB0232FA4}, {FC5886DA-E94D-4FED-B001-430247AE11C1}, {DACC4655-7A92-41E0-96A7-A283E5BD1AEE}, {C3157636-9CB5-4153-8B02-D9BC6D63F4D2}, {224F9D8B-6031-4194-8209-90E725DA55D1}, {738E0E75-020D-49D1-9852-54C9DCF67051}, {738E0E75-020D-49D1-9852-54C9DCF67051}, {2A43CD70-B0C1-41A7-959B-99EFD232E764}, {332078E2-D710-4D65-A529-2175C4359A6F}, {D1C7A2CE-5708-4454-889B-C1125FD83297}, {25BD9CAA-E37F-44C2-87C2-56C327C622FD}, {AB1098CC-4227-411B-BF9D-017D11705A06}, {43F7F290-F5CA-4E32-8D7F-205CEAC7ED7E}, {66C96C8E-B391-417B-A6C9-DA20EDCCFAEA}, {5D09A017-0BAC-4CFC-8ABA-BEA 1BF918B49}, {5FE207E0-2372-4082-BD08-AB9AA60799E7}, {CBA589DD-96CD-402A-96AC-5BFF7D114EBA}, {5B6F3441-978A-489D-AE9B-5B3699863351}, {1C2F9924-D80E-4CA8-A56B-78642B236FAF}, {724E55F3-E6D1-4D29-8B39-625418C3CCA8}, {492F451C-0B93-47C3-BC36-AFCB8A228D7C}, {99C7BB81-A9DC-48CB-A479-9A9980AA71FA}, {7473F324-AC8E-4C8C-A738-1E07FDA8E109}, {0A0807EE-C625-4815-80F7-A4B4AE974899}, {C18D2A4A-4547-4E43-865A-3FC6E833092C}, {B72345AA-C872-403A-B567-E1ADF63A5081}, {1B085774-3E4F-4FE8-8149-1FD7C2C5786A}, {F41A 1899-DA3B-4760-9EC1-451A0417D29F}, {29F8F17A-F2E8-4143-BE93-B4A6018D43E5}, {EE769139-367E-4C52-8814-3C9C61866BF7}, {38739E20-1D61-4BDC-BCDA-1AA25A40F2FE}, {F7624E50-66B4-4421-80C7-46480577468E}, {025AA6D1-C3F2-4E90-A4D6-F1917D171C6E}, {12712E54-8744-46B8-A141-0A81B64D7011}, {B5DCEC69-E9DF-4C25-A8FF-8496D332501C}
  #
  # Service:
  #
  # {06A62AD2-4385-4537-A887-09780EE5D984}, {9E4799FD-93FC-4D90-A07A-02E104F414F5}, {834228A8-28E4-411F-ADOF-A2DA8EFF 1309},{E891AFBA-7E22-4E5D-96A7-3D692B05249C}, {AD82425B-DFB2-4D8A-8EA6-BD4DC5BCC48B}, {3A75E8AB-EF76-413D-AEEC-4F2A90496C22}, {A03B27A3-B250-45CD-88D1-6AC64D4E03C0}, {8BB85CC6-2397-4F76-AC53-408A9CD54E8A},{0E1CF392-657A-4344-A3E9-F5C967596DDC}, {C9B2863B-0C3F-4255-8882-E08D8A14AECC}, {98BA40E9-8A42-43FE-84A7-C048AB2093B5}, {BFC537FE-5FCF-46CB-863B-02ECA93ECF 15}, {EF9FAE4F-3576-46D4-821D-DB3308F79D24}, {D134F861-7CB4-4640-8DC6-ABEB06CC8186}, {80495488-AA2E-4A52-9ECE-FE86C6EB902E}, {5082AC9E-8AE0-400B-835A-37FDBBD2DA32}, {74ACA5C1-50A4-42CA-B541-131848F2F9E5}
  #
  # Produkt:
  # {EA737657-9418-4E57-A421-4D15320E0F7F},{4F9F0189-756A-4075-9A52-38584C12BA3E},{033C529F-D5AB-4D63-9EDC-AD73F78F20BA},{D9283896-1EFB-4710-BFC2-B421480CC204},{30AC8E8B-C87A-447A-95DB-D7654C3816E1},{8814B967-C36C-488F-B294-577BD78321B0},{52927445-3733-4808-A24A-1DBC5BAE450E},{3F83B928-3602-41D9-88B8-D167F3128877},{3EAB14A4-BAD3-4A6A-B14C-2EF6E4161F2C},{6765C831-A263-4DBD-9830-D56C5C48C4F6},{83F1375F-EB1B-40A9-86B3-DFCD902D1B0C},{9329C04F-A85C-46FD-BC63-1BC3F05D6C9E},{0F0A569D-2FE7-4324-9ED7-5628C82C6893},{FAABE3B3-8BF8-4DA9-8CE8-04A2B0C5C3C2},{13E4B8B7-FD38-472A-ACD2-FC12B76D113A},{04993A6F-889C-4473-ADAF-7338528AEE75},{19531579-B6F6-4328-8D4E-1325C7F9D944},{8123D281-1ABB-47E0-B200-C28308395EAF},{00733775-C3B1-46DA-A60B-DB1D59B82C5A},{75B3F4B9-9CC0-4F83-9FF9-15F9E9C8A9A4},{1787D697-876C-4221-B83E-F0857D1087B3},{395E607C-10B2-45FE-BF3F-BE5E7B6471AD},{1A62A06A-87A2-42C3-B2EF-9971E74F3929},{E2F5376A-C2A8-4743-9627-579412864232},{6FE56029-9384-41AD-B0AE-4FA695022704},{F69DF94D-725B-4255-931A-9723C2CF3E5C},{6D26489F-2AE0-498D-A09F-A25B4D1137F5},{DDA27317-309A-4BD0-B3F9-1947256376A8},{A65DA19F-1762-45BF-97EA-FACA10377322},{56AF2076-5A0D-45F5-9D77-0E09B7723B13},{261C59F7-5CFB-4045-822B-CFA515D46F53},{6597280D-675C-4E3A-8CA9-B8BCC6691CF0},{74D787BE-BA0E-499E-B1B6-E2B14B609547},{519A8745-6A07-4D8B-9ECD-5BF656501BAD},{BD89A298-9ACF-4FD7-8562-5CA878B10BF1},{7CE6A4B9-4132-40D8-AB7D-52D157580038},{D963DDDE-C8CE-4619-8086-7040BACA12E5},{FE5D0805-1112-43D4-86DC-5AA0273FE6C7},{890DCB28-2C3C-4F2F-A2A1-93BF1E8E006D},{C97832AA-B2F3-4693-84F6-45456E67855A},{82A0CFFB-7E13-491B-A01C-5FCACDB19348},{1C2F98C5-CD84-4C79-A15A-24D78A85E254},{26C392C4-31EF-44D9-9BA8-963BB9B25672},{287B5AA8-CF7F-43AA-B74A-776135F18DFD},{80DD2B6C-F59C-43B1-8252-7081E3CE16C6},{32D9AF70-2F58-4DA7-BF8F-30DD0FF0E0C5},{2E442CF8-101F-4F1B-9347-EBF903108E7E},{6A89E9E2-CDDA-44C6-84A5-C888C50411D2},{36E75EB1-078C-460D-9783-00ED7ADDF0DC},{4EAC3460-D057-4EB4-97CD-9F49E2821417},{61F346B6-547C-4323-AE16-B7B430FF64A5},{BA18F1F8-36E1-49AA-9317-CC8A14609E86},{83BC60B4-B32E-43B9-9500-D334B44EC9F0},{F1FDE193-4694-472F-BFCF-31F5DD46AF5B},{7CA4EACC-025D-4C57-9C55-0EE85C8B1FBF},{60CC90CE-3861-461F-A8AA-04BC1D930505},{9A939EAF-2B92-4EA5-BB05-767687F6963B},{B56C4B5C-B0C3-47C8-9CD1-59FA53351C6C},{EA88672F-F46B-4D50-9E18-4E038DE198DD},{A918306D-D5CE-4046-ADB5-77A1A604340E},{F65C0E46-3CC9-464C-A30E-0CA226A5351C},{D7E18306-5BC3-426E-9A05-0F3974E06628},{9C29F1A7-DEA0-4841-8022-4B38338C2057},{68F70082-D9AE-4958-B525-15C94503CB30},{442F75F0-F5A5-43E2-AB50-4EDBCC482DF8},{FE078D75-F215-473C-9EAE-89FA1D066405},{318D6DD8-4370-40C4-9350-2E27CEE4C459},{FDB248C6-233E-4073-B320-C5EDFA964DDC},{1FE0C1D9-E983-4A3E-A622-0A20644958E2},{F7E21E3A-BDD9-4540-8308-DCF28808A2E4},{B6CC292C-A192-4438-AA03-AD98E36BC99B},{3A8E21E1-1BBD-47FF-BABB-3D8FFDFC396A},{63B3B5A7-22D8-44D0-9A0C-E49EDDB11ABF},{E5B58BD4-8595-4882-A2EF-9FEB6F9230AD},{C4FA2611-C71B-4A3F-865B-A9770991885C},{F1EA8973-33C0-4B60-A5DF-81B90DDF44BC},{0FF25CEB-CB76-4B31-A600-E17BEB5530FB},{C66B34BE-FDB7-469C-B20F-A80C5FF6CF88},{A90A75EC-69C5-4C4B-938F-ABC1BCD9C17F},{B57167C5-6876-45BF-8DAD-ACC7339FDAEC},{CE31AF4A-0919-4548-915E-192BF2E4BDD4},{CD61B0AB-5C3F-4638-8EA0-BADC67EBF588},{0A3EF61E-F132-487A-B750-DC4EB64F19AF},{D4807E4F-3881-469F-B827-A33C3A9A0A70},{F2275F7D-8E8E-46D0-8713-96D46992564C},{09D3A3CD-B9AE-46D3-AB67-B2534D60DF5E},{1AD8770B-E3A9-40C0-B998-7067C783385D},{0ABC5CC3-002A-4E0B-BF04-FADB7E839317},{20BF7842-6B07-4152-A19C-8B2DDEDCE335},{0513BF49-AE8C-4EB1-9FF2-C6E377FCD60A},{51367A3F-F84C-49AC-9489-6DF50556F0ED},{625A8DB3-AC2F-4A7A-8D3E-7D9A2696735A},{CBE4B86D-BBF1-460A-9EEB-E2ABDE0233AB},{3390A115-F807-4F33-BE1A-7719FDF85D28},{098F391B-61DF-4A68-B1F5-8AF20E3D178E},{2A68BA92-FF24-46C8-A856-20AC2EE5549B},{8157F433-1D2A-468D-9638-BD3076C309B1},{3CAE6FF3-98D3-4F7F-8CAD-91A9A4EB6043},{AE7851F5-2BE6-4F5E-937E-A23859908790},{E2F2409E-A578-4852-9B28-A2B7CC9054E9},{CB5FB525-6F3B-4FE7-8554-5355D529E8BE},{A7A0EF5A-8BC2-40B8-A983-A12002543E89},{ECD27E35-D543-4F81-94BA-D330E08A278B},{761DAC1A-EF9A-4AD5-BFAF-823EAFAE0011},{2D8433BD-96FB-4D85-B94C-75D43C84ABBA},{FA7F6AFE-3D63-444F-A705-01E12B87BAF1},{A95B95BE-96E0-4D9C-B6AF-FD19F6EDCD25},{648DF627-A820-4F7A-B79C-197B68CC10F3},{31748A41-0BCE-431A-892C-4578916A888C},{DF2617BC-B6BA-4B56-B72C-3D0899ACEAC5},{7BAD8020-9113-4CF2-9757-92B1A337A905},{75D28581-1379-4023-BFF0-CFBAE796C82D},{56D427CE-4388-4536-AF05-A827EAEF71B5},{E1E80B51-6A14-42A6-84CB-A25C49878352},{DE3F34D8-4581-4481-A1F2-D1DC4937705F},{682C6FB0-C94A-4484-9B27-E31E0EB134DE},{D068AFEE-B3C3-4DA4-937A-FC67EBF1D8E7},{B9B1036B-17F1-44CA-8318-C7C4198D9208},{805FF9C3-8A13-44FE-883B-8EF064C2D6B8},{7D7A7D29-366D-443A-A4EA-83DF823CFECF},{FA71B6C4-C74A-43E2-A85E-F5EC83687133},{A6EEE2E6-2212-4E73-BCAC-51A6F6087BC2},{F8AA9EC0-86B9-42EE-9DE0-BA9B14B40527},{7F5C56DF-E173-4519-8D9B-972D9C402153},{0C494E25-97B4-4A85-B85B-03482032E8BF},{CB668B8D-A87B-41BC-8B2F-4D6D24124864},{AB81A12D-06D0-45E1-8697-C9EB88ABFC09},{C6068470-9DCA-4BA6-94C5-5CE4773C1D2F},{2920903B-EE27-4EEC-AFE4-E0E890892150},{2E704D93-F1EB-45E5-97E6-453FF9B22EB3},{4844028C-0218-4C9F-94F0-DEFD553D71D3},{ACD99A57-DC4B-4C72-AAA1-6D6F0477D32F},{FF94ABEA-5423-496F-A098-51B03E042A3E},{C87FDCA9-4EC4-4CFA-B88E-24C98DC7E064},{3C9F4099-030C-4284-AD87-B776E9F1F6AC},{89BBFE1D-6698-44BF-A252-B30A833D9782},{7126B951-324A-4151-BE25-84C55DB4C4B4},{BBE7A6F8-5E5D-458D-9C38-9E64A63D5E9E},{06B13513-2C59-4BA0-850F-94FEB1E23733},{7EAD10B0-C927-42A2-A8E7-F5699FEC35BA},{FE51FE95-5197-4765-A51F-58F010E7A1EF},{77C9C145-9C3F-4F21-BD04-CC3A4C793083},{91B94D04-528D-4887-A545-59C27CD008C2},{D915C06C-6580-43C2-A585-861B96FACB5C},{AEFD1BCE-65E7-4780-ABA9-F82096F188BA},{43C62C0F-C866-4950-B655-D8E0886B1469},{F46C774C-7D60-4C85-BCA1-1CB209AFAFD7},{ACC5B8EB-134F-4552-9573-EC2BE2E5117E},{79FF9149-0184-42B7-865B-5CAADCFC80F8},{A2F9E0F0-F68C-4F24-9E9A-07808C234D2C},{9073100C-78C5-42D9-A548-C567D3CD9B14},{7D663AFF-7700-4CF6-99F7-58C95F5ECBC5},{D5FAD021-88A9-4FF1-AD3A-F45C92F35DBE},{0E74BD7F-2EEA-41C9-8504-73EF8FACF9EC},{43530B65-035C-4416-9E09-C89AAD6B3138},{060BB8B3-93E4-4C0A-903F-049C8F10881E},{5BE96088-65A1-4B30-B35B-C9F2B163BDAF},{D63CD06D-0055-45D1-8F4B-A4E1C8E8016C},{EE9325F0-FFA5-49E0-A303-46D2C79450BD},{8865FB7C-25EA-4CC1-ABAE-2217A9732E62},{66E3838B-5A9C-4D8B-8813-583CABC71269},{2F66E9B0-9D0E-4EE8-A5CF-739BA5DC817D},{A69A5C4E-F07D-4514-B69B-1A95CB1B4F19},{1B6024C6-1634-4C17-9835-9587375E7406},{3D4778FE-8D59-4C49-BB38-60C55157653C},{324F7ED5-256F-4AE1-A0C9-2C63D0F969DD},{0F018597-23CE-418D-956E-97A50E81981E},{5A4C7461-0293-4FE8-B06C-92014ACC1AA0},{A97DAA61-80DF-40A8-B5F4-06B9A61CA926},{69E9FFF2-B77F-4246-96B5-22C69D6373C5},{761ED2A8-774B-471A-90D6-79AD47F07822},{42528894-076B-4FE3-B66F-E2FC8C08D30D},{A6300352-318A-481A-BB36-27BACFEE6697},{52C8FD3F-40E4-4C30-89B7-CAAF3E8513D8},{237BE43F-F593-4C7A-91AF-1CDA720F24B6},{E676C7EF-0ADE-48C0-82C5-6318A1C758BC},{68D23A31-95F2-4FFE-947A-64C7906BEE6D},{87C1ED0C-9A53-401F-8638-E394F5220A9A},{44867B46-949C-43C3-BC8D-50256AB3A86B},{BDBB1EFC-EBF3-4A0C-8C27-D6E74B28330C},{67354A02-E290-49F7-865A-E64454D62B3A},{4A05B90C-9D82-453C-8E15-26FA3DFFE321},{6FF7095A-328F-4273-9F13-21020661EF21},{969E2B63-B7D4-49C6-95E4-B79C14A18654},{AD77E3B7-963B-4325-8B0C-568D70A33682},{9747C72E-2EF9-453C-984A-0C504E48A35A},{22B8E221-0A2C-4542-916D-2FD2BD9FC135},{D2FB3F03-122A-4DBF-902C-EF21DED4AD3D},{A56F8250-8D88-482A-8ECD-EB809DE76D09},{56EF4442-B273-4281-9DFD-59E2437690FD},{0CF97978-A390-4F5E-984C-3C2191CCF0AB},{DDAD2B9A-AE60-44F1-9C1E-27F51ACDD114},{2841ED07-8001-462E-87E8-4A3EE01469BD},{80B7AF0E-94A7-470F-BB04-AAFC33803E56},{CB958889-3EF8-493B-B74A-1AD3BB9FE4B0},{58AA74EC-ED87-4988-807B-88B793B8F02B},{02658C61-2DDD-4561-9FB6-887557B15A1B},{A0386F6E-A5A1-4B34-B5E6-052CD8D2C6FF},{EF6C3896-B3D5-4F3B-9815-337EDBC90CE2},{7BCDAA56-23EE-473F-9A1B-A9AC3816E32B},{84A9753A-7DCB-463F-9A4C-899E961F18F5},{66851CA1-68FF-4FFC-80AB-51B1013C57BA},{B62CC094-7855-456F-B899-AE6D386526AA},{1CFD61BF-1820-4E20-AD8A-4CF1D8A4049C},{7FD22927-6DAF-4FA9-800C-2771F6CFB212},{A222B867-D81A-4DDD-9255-E329D589F46F},{C5E346E6-AEC1-416D-AAAD-D688D1265623},{39EBFDBD-12EE-43D0-9117-2895DCCD140C},{C46BDB03-3A85-4771-9422-8F1360F68524},{382A254C-FFDC-4C40-9760-2EE48760809B},{6C758135-4DE1-4000-9CE1-E727FD6EEBC9},{770B0FB1-FB15-4791-B3FE-E1D707FBB6FA},{0DACDD33-14BD-416D-A411-D4D69FCC796F},{564979F9-FA0A-4455-954F-096B3A2668F1},{F5A79429-AFAE-4051-8F3A-1A5FB823A13D},{4794ABFE-7D5B-4952-A545-4E4A33779844},{2BE9396A-C73B-4A89-B093-1B95D8F71AA6},{5D703266-3B93-423D-A09C-62FCBFE6FB34},{2B1FABB2-ACCC-49BE-9E8A-6779BDA5AFC7},{7466AAFC-F967-4786-9B50-1E3AC8DF0F0E},{F3333BE8-1001-45ED-9522-D3116323BCBE},{5F499458-AC78-4F44-A860-83111EDEC201},{2E3B4429-D515-404C-85A4-7ACB4BAB8E8A},{E5DE9826-A91B-43BC-9E8F-4ADF800CAC7F},{94E6AF2F-6FDD-4D9C-8F90-7ED038B398E3},{CF6A8F8F-965D-4D7C-BCB1-C182E3733153},{9CEF3C3B-C34D-4B84-8ADF-C292330AA301},{0D9DEEED-6D01-4D2A-AF46-A09623751701},{BCB68934-8A87-4BA4-BF69-7D3B06A9BE11},{1DEF4C57-DA6E-44AC-B897-9BE1F049F1A6},{C4998270-1B48-4B66-B23A-159C21C2C8C0},{3C44FE72-6022-4830-B1BC-32B9C6E16C14},{62B03782-ECB3-4D43-BCCA-0FF14031501B},{2442CA8B-57E0-4726-B56B-559C71D3422E},{84AF6FAB-8A93-4278-8BD9-CB62ED23A0C6},{9D2AB5F4-91CF-48B0-B398-AD3EA5C4BC7E},{6E7D228A-4CFE-4291-AAB6-552B15B6821B},{BE103E27-8215-4B6A-8482-24480F2EED6C},{E89AD1F9-1EE3-40FA-B78B-B0CC15D26ADA},{12D237B0-C07B-42E2-8255-DC08A9CEB752},{7693ADC5-FAB3-4360-88A8-9DA20F847225},{90985A96-0B20-42F0-8D57-3ACFA97AFC9D},{4AF7C577-D270-48C4-9B46-22667ED9D313},{75234359-3F1B-4619-A787-F8E29E2C0042},{16DC5F46-66DF-4E78-A082-F9FD7901DFD5},{E462B3D4-3FCD-4ED5-9B8D-CAEC3C87C5CA},{C76A54C2-4A9D-47F6-BA58-D80734854623},{24E2AB5F-6ED4-4443-9CFA-75C4E6654CA3},{7B6C937F-EAA7-4307-9494-220119C1B542},{1A01E00E-FFBC-4C5E-8C61-B4ABF1EBB668},{48E61BE2-9CCA-48DA-B435-6F58307351C7},{75AFE0AD-7FE5-476F-BC2F-E81C52A3B6C1},{907B0483-E09E-47C6-A729-54E69F43C43A},{E511BB01-975B-43D5-A457-9FC1B04A3C10},{E7C1E817-4544-48B8-AB38-BB2854FB4311},{3B4AC9E4-4179-4AEE-81B7-ED555BA6DA6A},{4B00C2F5-7B3C-4710-8F12-852C044AAC3D},
  case (s7) {
    frame "1" {
      w39 = "°F"
    }
    frame "0", Default {
      w39 = "°C"
    }
  }
  $"Unit temp." <- w39
