vi "Specifications_haccp_iVario.gviweb"   [G Web Development Software 22.3.0]
inputs:
  "Output XML array": string[]
  "Error in": error
  "Energy consumption:": string
outputs:
  "Device Type": string
  "Software version": string
  "Error out": error
  "Start date": string
  "Temp Einheit": string
  "Rezept name": string
  "Charge nr": string
  "Spezifications": T1
panel indicators:
  "GUID": string
  "Serial number": string
types:
  T1 = cluster{"Device type:": string, "Device side:": string, "Serial number:": string, "Software version:": string, "Start date:": string, "Charge number:": string, "Prozess-Typ:": string, "Cooking programme name:": string, "Energy consumption:": string}
uses:
  NI::G Core::Strings::Trim Whitespace.gvi
diagram:
  s1 = ""  # shift register
  s2 = ""  # shift register
  s3 = ""  # shift register
  s4 = ""  # shift register
  s5 = ""  # shift register
  s6 = ""  # shift register
  s7 = ""  # shift register
  s8 = ""  # shift register
  for {
    w1 = each element of $"Output XML array"
    Match Pattern(regular expression=">", string=w1) -> (after substring=w2, before substring=w3)
    Match Pattern(regular expression="</", string=w2) -> (before substring=w4)
    case (w3) {
      frame "False", Default {
        w5 = s1
        w6 = s2
        w7 = s3
        w8 = s4
        w9 = s5
        w10 = $"Error in"
        w11 = s6
        w12 = s7
        w13 = s8
      }
      frame "1.7" {
        w5 = s1
        w6 = s2
        w7 = w4
        w8 = s4
        w9 = s5
        w10 = $"Error in"
        w11 = s6
        w12 = s7
        w13 = s8
      }
      frame "1.11" {
        w5 = s1
        w6 = s2
        w7 = s3
        w8 = s4
        w9 = s5
        w10 = $"Error in"
        w11 = s6
        w12 = s7
        w13 = w3
      }
      frame "1.3" {
        w5 = s1
        w6 = s2
        w7 = s3
        w8 = s4
        w9 = s5
        w10 = $"Error in"
        w11 = s6
        w12 = w4
        w13 = s8
      }
      frame "1.16" {
        w5 = s1
        w6 = s2
        w7 = s3
        w8 = s4
        w9 = s5
        w10 = $"Error in"
        w11 = w4
        w12 = s7
        w13 = s8
      }
      frame "1.10" {
        w5 = s1
        w6 = s2
        w7 = s3
        w8 = s4
        w9 = w4
        w10 = $"Error in"
        w11 = s6
        w12 = s7
        w13 = s8
      }
      frame "1.4" {
        w5 = s1
        w6 = s2
        w7 = s3
        w8 = w4
        w9 = s5
        w10 = $"Error in"
        w11 = s6
        w12 = s7
        w13 = s8
      }
      frame "1.6/" {
        call "Trim Whitespace.gvi"(string=w4) -> (trimmed string=w14)
        Match Pattern(regular expression="<_1.7>", string=w14) -> (after substring=w7)
        w5 = s1
        w6 = s2
        w8 = s4
        w9 = s5
        w10 = $"Error in"
        w11 = s6
        w12 = s7
        w13 = s8
      }
      frame "1.2" {
        w5 = w4
        w6 = s2
        w7 = s3
        w8 = s4
        w9 = s5
        w10 = $"Error in"
        w11 = s6
        w12 = s7
        w13 = s8
      }
      frame "1.5" {
        w5 = s1
        w6 = w4
        w7 = s3
        w8 = s4
        w9 = s5
        w10 = $"Error in"
        w11 = s6
        w12 = s7
        w13 = s8
      }
    }
    next s1 = w5
    next s2 = w6
    next s3 = w7
    next s4 = w8
    next s5 = w9
    next s6 = w11
    next s7 = w12
    next s8 = w13
  }
  $"Software version" <- s2
  $"Rezept name" <- "Operating mode / \nCooking process"
  call "Trim Whitespace.gvi"(string=s5) -> (trimmed string=w15)
  call "Trim Whitespace.gvi"(string=s1) -> (trimmed string=w16)
  call "Trim Whitespace.gvi"(string=s4) -> (trimmed string=w17)
  call "Trim Whitespace.gvi"(string=s3) -> (trimmed string=w18)
  call "Trim Whitespace.gvi"(string=s2) -> (trimmed string=w19)
  call "Trim Whitespace.gvi"(string=s6) -> (trimmed string=w20)
  case (w20) {
    frame "False", Default {
      w21 = "not found"
      w22 = w10
    }
    frame "{F1EC9F5D-A5BF-4B87-9643-AE4C475E86CC}" {
      w21 = "Roast"
      w22 = w10
    }
    frame "{5B1CB67A-C312-4AE7-A8CC-0AC096F56AAA}" {
      w21 = "Frying "
      w22 = w10
    }
    frame "{14154E87-4DC5-46BE-A48B-369C218CD08A}" {
      w21 = "Braise meat"
      w22 = w10
    }
    frame "{97A9653C-6FDC-4EC1-BA76-70CD3EEB0FEA}" {
      w21 = "Deep frying meat"
      w22 = w10
    }
    frame "{B51413B7-9B8D-4637-80BF-8E104B9D37FA}" {
      w21 = "Roast meat"
      w22 = w10
    }
    frame "{57B64B24-ABBC-474A-B337-4B1DD1C541B7}" {
      w21 = "Side dishes Cooking potatoes"
      w22 = w10
    }
    frame "{F522428E-4454-42D5-AC1B-C7618CC43EB9}" {
      w21 = "Fried eggs"
      w22 = w10
    }
    frame "{014E63A6-91B4-4932-9D64-9068A5E3899B}" {
      w21 = "Egg omelette"
      w22 = w10
    }
    frame "{A529A8EC-F6DB-452F-A216-BE9DCC4C0501}" {
      w21 = "Meat cooking"
      w22 = w10
    }
    frame "{7E754ABE-8CB2-4247-A03C-771CE4AD4177}" {
      w21 = " Fisch Dämpfen"
      w22 = w10
    }
    frame "{6C58E961-881D-4BC0-B912-44AA64F8AF47}" {
      w21 = "Sous vide meat"
      w22 = w10
    }
    frame "{1E8A5BED-9EDA-4629-90C3-3BE63CB36E87}" {
      w21 = "Meat confit"
      w22 = w10
    }
    frame "{2946233B-DF20-488C-BF5D-530094B87D8A}" {
      w21 = "Meat Sausages Broths"
      w22 = w10
    }
    frame "{52FC21C6-F65C-42AE-A157-7656AC49777C}" {
      w21 = "Meat ragout"
      w22 = w10
    }
    frame "{37CDD65D-B81B-4605-B93F-31FE9D24E38C}" {
      w21 = "Cooking meat overnight"
      w22 = w10
    }
    frame "{FC19B71C-36FA-4C91-A5B4-502BC8F5F499}" {
      w21 = "Milk and desserts Milk cooking"
      w22 = w10
    }
    frame "{FDEBAA55-C323-4B60-83BC-80848B186CC8}" {
      w21 = "Milk and desserts Pudding \n+ sauce"
      w22 = w10
    }
    frame "{8A51293C-76B5-4CA4-B1A1-805B98732F7B}" {
      w21 = "Egg dishes Kaiserschmarren"
      w22 = w10
    }
    frame "{222F2283-49FF-494B-8066-CA4A3BBE0CA8}" {
      w21 = "Suppen Saucen Convenience"
      w22 = w10
    }
    frame "{95806C6D-0802-45A1-8A0A-0582DB380211}" {
      w21 = "Finishing soups sauces"
      w22 = w10
    }
    frame "{A651D927-4794-4AC4-BD92-E9BB027911BF}" {
      w21 = "Soups Sauces Bechamel Veloute"
      w22 = w10
    }
    frame "{597A1F24-6518-4266-8571-1D3649E63D87}" {
      w21 = "Sides Polenta"
      w22 = w10
    }
    frame "{38BB32AC-4562-43A2-9674-977D416C477E}" {
      w21 = "Manual cooking"
      w22 = w10
    }
    frame "{5EC7E7CC-DBBD-40CE-AC81-D89745BD47D3}" {
      w21 = "Side dish cooking"
      w22 = w10
    }
    frame "{10E82303-A36B-4E79-8727-5FD1574C5581}" {
      w21 = "Milk and desserts Rice pudding"
      w22 = w10
    }
    frame "{5485695E-4E6C-487E-BF3C-1281D2BA0C01}" {
      w21 = "Poaching fish"
      w22 = w10
    }
    frame "{67A0CA04-D69E-4808-8B08-A194398AD7B5}" {
      w21 = "Steaming meat"
      w22 = w10
    }
    frame "{2E2A0F8E-5B00-4664-BCBF-2BDAECE5F57C}" {
      w21 = "Steam side dishes"
      w22 = w10
    }
    frame "{B5ACA17F-6B44-464C-B39D-0C05E5762E3A}" {
      w21 = "Fish confit"
      w22 = w10
    }
    frame "{DB8A4BB2-1225-4860-87BD-4984E36C9932}" {
      w21 = "Steaming milk and desserts"
      w22 = w10
    }
    frame "{547EC271-8C58-4708-927B-281C8BC5A576}" {
      w21 = "Deep-frying fish"
      w22 = w10
    }
    frame "{122129B2-3F4E-41D8-BB33-9BBDC5B13EF7}" {
      w21 = "Sous vide fish"
      w22 = w10
    }
    frame "{4BE1166B-089C-4E4B-8D2C-B987731C0613}" {
      w21 = "Fish Seafood Cooking"
      w22 = w10
    }
    frame "{A8E9604C-E19A-4FEC-88C6-C48D25EC8D37}" {
      w21 = "Egg dishes Poaching eggs"
      w22 = w10
    }
    frame "{6509EAAB-9A69-45A6-95CB-6011F01160F8}" {
      w21 = "Side dishes rice cooking"
      w22 = w10
    }
    frame "{53CEBCBE-F670-474B-B751-A9F9637B2A5F}" {
      w21 = "JP Tamagoyaki egg dishes"
      w22 = w10
    }
    frame "{DB0F7019-5A7D-45D0-B9B4-C0C46D148E50}" {
      w21 = "JP Gyoza side dishes"
      w22 = w10
    }
    frame "{9CCDFF89-5F32-433A-872F-E856C13753EB}" {
      w21 = "Side dishes sous vide"
      w22 = w10
    }
    frame "{76CCAED3-46A9-4528-A2E4-0F67229A6CFE}" {
      w21 = "Side dishes sous vide"
      w22 = w10
    }
    frame "{D905FC70-26FE-4361-841C-CF7EB5AB02F8}" {
      w21 = "Meat overnight ragout"
      w22 = w10
    }
    frame "{AC90B87A-851F-4974-AF85-3BBEBA4CA38A}" {
      w21 = "Braise fish"
      w22 = w10
    }
    frame "{6007EF01-EB38-4F45-ADBE-B5F936248095}" {
      w21 = "Finishing Glaze inserts"
      w22 = w10
    }
    frame "{C35385BF-4660-4C69-936A-51376368D360}" {
      w21 = "Finishing meat in a sauce"
      w22 = w10
    }
    frame "{73CC0056-87E2-4D31-8DA3-8ACCD77928EC}" {
      w21 = "Soups Sauces Soup"
      w22 = w10
    }
    frame "{8615E55F-80DF-4BA1-84A7-0335FA572EB5}" {
      w21 = "Scrambled egg dishes"
      w22 = w10
    }
    frame "{6C265656-689C-4C74-9A9F-635C1EDE38C2}" {
      w21 = "Egg dishes JP Onsen Tamago"
      w22 = w10
    }
    frame "{7CF10941-AA8B-41BA-8426-4DA4C4898039}" {
      w21 = "Fish Seafood Roast"
      w22 = w10
    }
    frame "{91536D42-994F-4C24-88AD-1457CDB19811}" {
      w21 = "Dairy and sweet dishes \nDeep-frying"
      w22 = w10
    }
    frame "{472F76E4-F1B6-4670-B4BD-5F74F50A6726}" {
      w21 = "Dairy and sweet dishes \nRoasting nuts"
      w22 = w10
    }
    frame "{73326502-244E-4CB6-BFE7-01A18EDA5593}" {
      w21 = "Milk and desserts Melting \nchocolate"
      w22 = w10
    }
    frame "{A9DF25A7-FEA7-459B-894F-96E0C61112C2}" {
      w21 = "Side dishes Confit"
      w22 = w10
    }
    frame "{7DE9039C-B156-4C43-A0C6-E41A53FC3210}" {
      w21 = "Stew meat overnight"
      w22 = w10
    }
    frame "{C99C0D43-0C2C-4451-BA82-DCFB1F475218}" {
      w21 = "Dairy and desserts Sugar Cooking Caramel"
      w22 = w10
    }
    frame "{5BE910D5-95CA-48F7-B027-89DEBC6F0D48}" {
      w21 = "Dairy and desserts Fruits Cooking"
      w22 = w10
    }
    frame "{03DADB22-5777-4F09-9A84-B11C0EF7331E}" {
      w21 = "Soup sauces"
      w22 = w10
    }
    frame "{2EB2C441-89BB-4F1B-BDC0-2EF3CD16DA44}" {
      w21 = "Reduce soups sauces"
      w22 = w10
    }
    frame "{A5141EF1-787E-4873-BB49-8FEE8C978DD9}" {
      w21 = "Soups Sauces Stock"
      w22 = w10
    }
    frame "{C6D16EC3-090F-4B6A-B265-D51BA2DA34CD}" {
      w21 = "Egg dishes Cooking eggs"
      w22 = w10
    }
    frame "{7BCAA527-D2C7-420E-A091-94C893153871}" {
      w21 = "Egg dishes Pancakes"
      w22 = w10
    }
    frame "{443EEC20-C943-456F-9D9B-87410095870B}" {
      w21 = "Fish roast"
      w22 = w10
    }
    frame "{795A0A29-9C80-411C-900A-6AA5BACD50BC}" {
      w21 = "Side dishes Cooking Pressure"
      w22 = w10
    }
    frame "{88A398A6-EC7E-436E-A76F-70CB1E0CF5B6}" {
      w21 = "Meat cooking Pressure"
      w22 = w10
    }
    frame "{EA019C20-C014-4934-89E9-44011905A173}" {
      w21 = "Meat ragout Pressure"
      w22 = w10
    }
    frame "{B980EDF7-A5FB-4EA3-ABFC-952E6564AE75}" {
      w21 = "Stewing meat Pressure"
      w22 = w10
    }
    frame "{07CC88AC-A9D4-4103-A636-413A091EB32A}" {
      w21 = "Side dishes Potatoes \nCooking Pressure"
      w22 = w10
    }
    frame "{5B2D83A6-92A7-4840-A26B-DDB529C430DB}" {
      w21 = "Milk and desserts \"Kaiserschmarren\""
      w22 = w10
    }
    frame "{ED462232-9AC4-4E4D-A985-2B18BBA364EA}" {
      w21 = "Side dishes Cooking pasta"
      w22 = w10
    }
    frame "{F50B26FB-7796-42EC-97DB-7A5F94F2CF65}" {
      w21 = "Milk and dessert crepes"
      w22 = w10
    }
    frame "{C3BBC1E5-DA7A-43C6-9E52-42994DE41622}" {
      w21 = "Soups Sauces Sauce"
      w22 = w10
    }
    frame "{924FF526-99F8-46DF-9630-9F42070E98C1}" {
      w21 = "Soups Sauces Soup pressure"
      w22 = w10
    }
    frame "{E55731C2-5F76-47DF-8F87-DBBA0537A070}" {
      w21 = "Soups Sauces Sauce pressure"
      w22 = w10
    }
    frame "{64E6B664-4CAD-4A58-9231-70CFA1089E33}" {
      w21 = "Soups Sauces Stock pressure"
      w22 = w10
    }
    frame "{69268FFB-712D-47A1-AF8E-8B2D52012A0E}" {
      w21 = "Fish stewing pressure"
      w22 = w10
    }
    frame "{9CF563D2-67DC-49D6-A3BB-FA8318EA067E}" {
      w21 = "Side dishes paella"
      w22 = w10
    }
    frame "{CFBA3DDE-EDF5-4CF0-A7D2-428E8711FA88}" {
      w21 = "Risotto side dishes"
      w22 = w10
    }
    frame "{F937A38A-D1EC-4ED5-BEB1-7B1CF1A94AE0}" {
      w21 = "Meat CHN Stew"
      w22 = w10
    }
    frame "{75CD3EB0-53AB-4897-9C84-C7534772A2B6}" {
      w21 = "Sides Convenience puree"
      w22 = w10
    }
    frame "{96FB24CF-DC88-4D4E-98B0-7E0CE0B689BF}" {
      w21 = "Side dishes CHN Congee"
      w22 = w10
    }
    frame "{0A22FFEB-ED15-472F-8FF1-B76A2EC21533}" {
      w21 = "Sides CHN Fried Dumplings \nGyoza"
      w22 = w10
    }
    frame "{DCB143C5-3975-4CFD-831D-43B09E44A668}" {
      w21 = "Side dishes Rice Cooking \nPressure"
      w22 = w10
    }
    frame "{BB176372-E97A-4B34-8FC0-4FAD83387144}" {
      w21 = "Supplements CHN Zongzi \npressure"
      w22 = w10
    }
    frame "{59111FFD-294C-41A3-A52F-752E4BAABDF8}" {
      w21 = "Meat CHN Lou Mei"
      w22 = w10
    }
    frame "{23754E7C-F5C5-4070-A6F1-DC83EB5E20BF}" {
      w21 = "Meat CHN Lou Mei"
      w22 = w10
    }
    frame "{F35A640B-645D-43FD-842C-A853152BA4C4}" {
      w21 = "Fish roast WA82"
      w22 = w10
    }
    frame "{99846438-F5BE-4382-9C26-941F462CDA99}" {
      w21 = "Fish Seafood Roast \nWA82"
      w22 = w10
    }
    frame "{6FC603A5-8658-4BFA-9EA0-F486C96DB74D}" {
      w21 = "Side dishes Roast WA82"
      w22 = w10
    }
    frame "{26F12F90-7E27-4406-90CE-E34289F818F0}" {
      w21 = "Glaze inserts WA82"
      w22 = w10
    }
    frame "{9A990D7D-2DF2-44B4-B9C2-630F44D6412F}" {
      w21 = "Egg dishes and desserts Fried eggs WA82"
      w22 = w10
    }
    frame "{DEDE609F-A6C1-47AD-A5D0-5DFB47355999}" {
      w21 = "Egg dishes and desserts Omelette \nWA82"
      w22 = w10
    }
    frame "{B5CE2367-6200-4652-B2D0-E08EFBBACFB9}" {
      w21 = "Egg dishes and desserts DACH FI HU Kaiserschmarren WA82"
      w22 = w10
    }
    frame "{E69CB6E7-E860-4BD4-B460-AC2EA622B61B}" {
      w21 = "Egg dishes and desserts JP \nTamagoyaki WA82"
      w22 = w10
    }
    frame "{9D192AFB-45B8-4D02-A041-4C105FC5ADA2}" {
      w21 = "Egg dishes and desserts Scrambled \neggs WA82"
      w22 = w10
    }
    frame "{2625CA6C-E1D8-44C2-AA3B-207080DA68A9}" {
      w21 = "Egg dishes and desserts Roast nuts WA82"
      w22 = w10
    }
    frame "{00B6654E-672C-4D9C-9AC7-8CFDA3C59347}" {
      w21 = "Egg dishes and desserts Crepes \nWA82"
      w22 = w10
    }
    frame "{E4F37828-8746-4F63-9C0D-65F6CA02EFFA}" {
      w21 = "Meat Stir Fry"
      w22 = w10
    }
    frame "{8D4DE10D-484A-4A6C-9232-5DDA5618E590}" {
      w21 = "Fish Stir Fry"
      w22 = w10
    }
    frame "{A72468FC-43BB-431A-AB51-EC8D5A7C5379}" {
      w21 = "Stir Fry side dishes"
      w22 = w10
    }
  }
  call "Trim Whitespace.gvi"(string=w21) -> (trimmed string=w23)
  Property Node(instance in=T1 {all zero or empty}, "Device type:"=w16, "Device side:"=s7, "Serial number:"=w17, "Start date:"=w18, "Charge number:"=w15, "Prozess-Typ:"="Operating mode / \nCooking process", "Cooking programme name:"=w23, "Energy consumption:"=$"Energy consumption:", "Software version:"=w19) -> (instance out=w24)
  $Spezifications <- w24
  $"Start date" <- s3
  $"Serial number" <- s4
  $"Device Type" <- s1
  $"Error out" <- w22
  $"Charge nr" <- w15
  case (s8) {
    frame "1" {
      w25 = "°F"
    }
    frame "0", Default {
      w25 = "°C"
    }
  }
  $"Temp Einheit" <- w25
  $GUID <- w20
