vi "iCombi-Pro.gviweb"   [G Web Development Software 22.3.0]
panel controls:
  "Analyse": bool  # Press the button “Analyse” and select a service report xml file.
  "icombi pro xml": i32 = 1
  "common_icombi_pro": T4[]
  "i Combi Pro txt": i32
  "Press the button to display details:": bool
  "Engine Link": string = "index.html"
  "Sort Process name": bool
  "Press the button to display the graphic of the two selected cleaning processes": bool
  "Default View": bool = TRUE
  "common_icombi_pro_2": T4[]
panel indicators:
  "common": T1[]
  "Graph Display": T2[]
  "Specifications": T3
  "URL-Grafik": string
  "Specifications:": T5[]
  "Details of the selected programme:": cluster{"Information": string, "Detail": string}[]
  "Programme details": T1[]
  "Graph Display_txt": T2[]
  "Curve": T2[]
  "General statistics:": cluster{"Process": string, "quantity": string}[]
  "Cleaning graphic:": cluster{"Element 1": f64[], "Element 2": f64[]}[]
  "Cleaning statistics:": T6[]
  "URL-cleaming_graphic": string
  "Max temperature (C°/°F):": f64
  "Average temperature (C°/°F):": f64
  "Please wait...": f64
  "Details of the programme:": cluster{"Information": string, "Detail": string}[]
  "Programme details_2": T1[]
  "Cleaning process table": T4[]
  "Graph Display multiple": cluster{"Element 1": f64[], "Element 2": f64[]}[]
  "same programme type ?": bool
  "banner": string
  "HACCP File Content:": string
  "common_2": T7[]
types:
  T1 = cluster{"Mode/Event": string, "Cooking cabinet temp.": string, "Core probe Setpoint temp.": string, "Core sensor actual temp.": string, "Date and Time ⌚": string}
  T2 = cluster{"Element 1": timestamp[], "Element 2": f64[]}
  T3 = cluster{"Device type:": string, "Serial number:": string, "Software version:": string, "Start date:": string, "Charge number:": string, "Prozess-Typ:": string, "Cooking programme name:": string, "Energy consumption:": string}
  T4 = cluster{"Selected": bool, "Charge Nr.": string, "Process name": string, "Programme name": string, "Date and time ⌚": string, "Duration": string, "Status": string, "Average temp. (°C/°F)": string}
  T5 = cluster{"Information": string, "Details": string}
  T6 = cluster{"Cleaning name": string, "Standard cleaning": f64, "Eco cleaning": f64, "Aborted cleaning": f64}
  T7 = cluster{"Mode/Event": string, "Cooking cabinet temp.": string, "Core probe Setpoint temp.": string, "Core sensor actual temp.": string, "Used heating elements": string, "Date and Time ⌚": string}
  T8 = cluster{"selected": bool, "Charge Nr.": string, "Process name": string, "Programme name": string, "Date and time": string, "Duration": string, "Status": string, "Average temp.": string}
  T9 = cluster{"Device type:": string, "Serial number:": string, "Software version:": string, "Start date:": string, "Charge number:": string, "Prozess-Typ:": string, "Cooking programme name": string, "Energy consumption:": string}
uses:
  FileTasks::Read File Text.gvi
  WebApp::Check_File_Content_iCombi_Pro.gviweb
  WebApp::Read_XML_Part.gviweb
  WebApp::Specifications_haccp.gviweb
  WebApp::Get_All_Part_Txt.gviweb
  WebApp::Specifications_txt.gviweb
  WebApp::Add_Parts.gviweb
  WebApp::Measurements.gviweb
  ControlExtensions::Data Grid - String Column - Create Background Color Style.gvi
  WebApp::Measurements_Txt_iCombiPro.gviweb
  WebApp::Get_Cleaning_Processes.gviweb
  WebApp::Display_all_programm_in_graph.gviweb
  WebApp::Display_Details.gviweb
  WebApp::Sort_table.gviweb
  WebApp::Select_more_than_Cleaning_process.gviweb
diagram:
  w1 = "Init"  # State
  s1 = w1  # shift register
  s2 = ""  # shift register
  s3 = ""  # shift register
  s4 = ""  # shift register
  s5 = T9 {all zero or empty}  # shift register
  s6 = T8[] []  # shift register
  s7 = string[] []  # shift register
  s8 = ""  # shift register
  while {
    # s4: Energieverbrauch
    # s3: Start time & date
    # s6: General information txt
    # s5: Specifications
    # s2: Inhalt txt/XML
    # s7: Selected Charge nr
    case (s1) {
      frame "Init", Default {
        w11 = "Wait For Interaction"  # State
        Property Node(instance in=reference to "Please wait...", "Visible"=FALSE, error in=no error) -> (error out=w12, instance out=w13)
        Close Reference(error in=w12, reference=w13) -> (error out=w14)
        Property Node(instance in=reference to "common", "Visible"=FALSE, error in=w14) -> (error out=w15, instance out=w16)
        Close Reference(error in=w15, reference=w16) -> (error out=w17)
        Property Node(instance in=reference to "Specifications", "Visible"=FALSE, error in=w17) -> (error out=w18, instance out=w19)
        Close Reference(error in=w18, reference=w19) -> (error out=w20)
        Property Node(instance in=reference to "icombi pro xml", "Visible"=FALSE, error in=w20) -> (error out=w21, instance out=w22)
        Close Reference(error in=w21, reference=w22) -> (error out=w23)
        Property Node(instance in=reference to "i Combi Pro txt", "Visible"=TRUE, error in=w23) -> (error out=w24, instance out=w25)
        Close Reference(error in=w24, reference=w25) -> (error out=w26)
        Property Node(instance in=reference to "Press the button to display details:", "Disabled"=TRUE, error in=w26) -> (error out=w27, instance out=w28)
        Close Reference(error in=w27, reference=w28) -> (error out=w29)
        Property Node(instance in=reference to "Sort Process name", "Disabled"=TRUE, error in=w29) -> (error out=w30, instance out=w31)
        Close Reference(error in=w30, reference=w31) -> (error out=w32)
        Property Node(instance in=reference to "Default View", "Disabled"=TRUE, error in=w32) -> (error out=w33, instance out=w34)
        Close Reference(error in=w33, reference=w34) -> (error out=w2)
        $"URL-Grafik" <- "Rational_logo.jpg"
        $"URL-cleaming_graphic" <- "Legende_Cleaning_graphic.png"
        w3 = w11
        w4 = s2
        w5 = s3
        w6 = s4
        w7 = s5
        w8 = s6
        w9 = s7
        w10 = s8
      }
      frame "Read XML File" {
        call "Read File Text.gvi"(allowed file types=[".xml", ".txt"], error in=no error) -> (file content=w35, file name=w36, error out=w37)
        Match Pattern(regular expression=".xml", string=w36) -> (match substring=w38)
        call "Check_File_Content_iCombi_Pro.gviweb"(Inhalt Haccp=w35, file type xml=w38, file type_txt=w36, Error input=w37) -> (HACCP File Content=w39, i Combi Pro ?=w40, Error Output=w41)
        case (w40) {
          frame False, Default {
            Property Node(instance in=reference to "Specifications:", "Value"=T5[] [], error in=w41) -> (error out=w42, instance out=w43)
            Close Reference(error in=w42, reference=w43) -> (error out=w44)
            Property Node(instance in=reference to "common_icombi_pro", "Value"=T4[] [], error in=w44) -> (error out=w45, instance out=w46)
            Close Reference(error in=w45, reference=w46) -> (error out=w2)
            w3 = "Wait For Interaction"
          }
          frame True {
            case (w38) {
              frame "False", Default {
                Match Pattern(regular expression=".txt", string=w36) -> (match substring=w47)
                case (w47) {
                  frame ".txt" {
                    w48 = "Specifications TXT"  # State
                    Property Node(instance in=reference to "i Combi Pro txt", "Visible"=TRUE, error in=w41) -> (error out=w49, instance out=w50)
                    Close Reference(error in=w49, reference=w50) -> (error out=w51)
                    Property Node(instance in=reference to "icombi pro xml", "Visible"=FALSE, error in=w51) -> (error out=w52, instance out=w53)
                    Close Reference(error in=w52, reference=w53) -> (error out=w54)
                    Property Node(instance in=reference to "Specifications:", "Value"=T5[] [], error in=w54) -> (error out=w55, instance out=w56)
                    Close Reference(error in=w55, reference=w56) -> (error out=w57)
                    Property Node(instance in=reference to "common_icombi_pro", "Value"=T4[] [], error in=w57) -> (error out=w58, instance out=w59)
                    Close Reference(error in=w58, reference=w59) -> (error out=w2)
                    w3 = w48
                  }
                  frame "False", Default {
                    w60 = "Wait For Interaction"  # State
                    w3 = w60
                    w2 = w41
                  }
                }
              }
              frame ".xml" {
                w61 = "Specifications XML"  # State
                Property Node(instance in=reference to "i Combi Pro txt", "Visible"=FALSE, error in=w41) -> (error out=w62, instance out=w63)
                Close Reference(error in=w62, reference=w63) -> (error out=w64)
                Property Node(instance in=reference to "icombi pro xml", "Visible"=TRUE, "ActiveTab"=0, "Value"=0, error in=w64) -> ("Tab"=w65, instance out=w66)
                Property Node(instance in=w65, "Visible"=TRUE) -> (error out=w67)
                Close Reference(error in=w67, reference=w66) -> (error out=w2)
                w3 = w61
              }
            }
          }
        }
        Concatenate Strings(w35, ";") -> w4
        $"HACCP File Content:" <- w39
        w5 = s3
        w6 = s4
        w7 = s5
        w8 = s6
        w9 = s7
        w10 = s8
      }
      frame "Specifications XML" {
        w68 = "Get Events from XML"  # State
        Property Node(instance in=reference to "Details of the programme:", "Visible"=FALSE, error in=no error) -> (error out=w69, instance out=w70)
        Close Reference(error in=w69, reference=w70) -> (error out=w71)
        Property Node(instance in=reference to "Programme details_2", "Visible"=FALSE, error in=w71) -> (error out=w72, instance out=w73)
        Close Reference(error in=w72, reference=w73) -> (error out=w74)
        call "Read_XML_Part.gviweb"(Input XML=s2, Start XML Part="<_1>", End XML Part="</_1>", Error in=w74) -> (Output XML array=w75, Error out=w76)
        call "Specifications_haccp.gviweb"(Output XML array=w75, Energy consumption:=s4, Error in=w76) -> (Specifications=w7, Unit temp.=w10, Start date=w5, Error out=w2)
        w3 = w68
        w4 = s2
        w6 = s4
        w8 = s6
        w9 = s7
      }
      frame "Specifications TXT" {
        call "Get_All_Part_Txt.gviweb"(Happ_file=s2, Error input=no error) -> (Get all charge=w77, Error Output=w78)
        Array Size(array=w77) -> (size(s)=w79)
        Is Greater(x=w79, y=1) -> w80
        case (w80) {
          frame False, Default {
            Property Node(instance in=reference to "Details of the programme:", "Visible"=TRUE, error in=w78) -> (error out=w81, instance out=w82)
            Close Reference(error in=w81, reference=w82) -> (error out=w83)
            Property Node(instance in=reference to "Programme details_2", "Visible"=TRUE, error in=w83) -> (error out=w84, instance out=w85)
            Close Reference(error in=w84, reference=w85) -> (error out=w86)
            Property Node(instance in=reference to "common", "Visible"=FALSE, error in=w86) -> (error out=w87, instance out=w88)
            Close Reference(error in=w87, reference=w88) -> (error out=w89)
            Property Node(instance in=reference to "Specifications", "Visible"=FALSE, error in=w89) -> (error out=w90, instance out=w91)
            Close Reference(error in=w90, reference=w91) -> (error out=w92)
            Property Node(instance in=reference to "icombi pro xml", "Visible"=TRUE, "ActiveTab"=0, "Value"=0, error in=w92) -> ("Tab"=w93, instance out=w94)
            Property Node(instance in=w93, "Visible"=TRUE) -> (error out=w95, instance out=w96)
            Close Reference(error in=w95, reference=w96) -> (error out=w97)
            Close Reference(error in=w97, reference=w94) -> (error out=w98)
            Property Node(instance in=reference to "i Combi Pro txt", "Visible"=FALSE, error in=w98) -> (error out=w99, instance out=w100)
            Close Reference(error in=w99, reference=w100) -> (error out=w2)
            w101 = "Get  Event from one TXT"  # State
            w3 = w101
          }
          frame True {
            w102 = "Get Events from TXT"  # State
            Property Node(instance in=reference to "common", "Visible"=FALSE, error in=w78) -> (error out=w103, instance out=w104)
            Close Reference(error in=w103, reference=w104) -> (error out=w105)
            Property Node(instance in=reference to "Specifications", "Visible"=FALSE, error in=w105) -> (error out=w106, instance out=w107)
            Close Reference(error in=w106, reference=w107) -> (error out=w108)
            Property Node(instance in=reference to "icombi pro xml", "Visible"=FALSE, error in=w108) -> (error out=w109, instance out=w110)
            Close Reference(error in=w109, reference=w110) -> (error out=w111)
            call "Specifications_txt.gviweb"(Get all charge=w77, Error input=w111) -> (General information=w112, Error Output=w2)
            $"Specifications:" <- w112
            w3 = w102
          }
        }
        w4 = s2
        w5 = s3
        w6 = s4
        w7 = s5
        w8 = s6
        w9 = s7
        w10 = s8
      }
      frame "Get Events from XML" {
        Property Node(instance in=reference to "common", "Visible"=TRUE, error in=no error) -> (error out=w113, instance out=w114)
        Close Reference(error in=w113, reference=w114) -> (error out=w115)
        Property Node(instance in=reference to "Specifications", "Visible"=TRUE, error in=w115) -> (error out=w116, instance out=w117)
        Close Reference(error in=w116, reference=w117) -> (error out=w118)
        call "Add_Parts.gviweb"(Imput XML=s2, Error input=w118) -> (Output all Parts=w119, Output=w120)
        call "Measurements.gviweb"(Output all Parts=w119, Start date and time=s3, Unit Temp=s8, Error input=w120) -> (average temp.=w121, max value=w122, General information=w123, Observed Data and Fitted Curve=w124, Energieverbrauch=w6, Output Error=w125)
        $common <- w123
        w126 = "Wait For Interaction"  # State
        Property Node(instance in=reference to "Please wait...", "Visible"=FALSE, error in=w125) -> (error out=w127, instance out=w128)
        Close Reference(error in=w127, reference=w128) -> (error out=w129)
        call "Data Grid - String Column - Create Background Color Style.gvi"(reference in=reference to "common", column index=4, color=4294965402, error in=w129, match operator="contains", match text="1904") -> (reference out=w130, error out=w131)
        Close Reference(error in=w131, reference=w130) -> (error out=w2)
        $"Graph Display" <- w124
        $"Max temperature (C°/°F):" <- w122
        $"Average temperature (C°/°F):" <- w121
        Property Node(instance in=s5, "Energy consumption:"=w6) -> (instance out=w7)
        Property Node(instance in=w7) -> ("Start date:"=w132)
        String Length(string=w132) -> (length=w133)
        Is Greater Than 0(x=w133) -> w134
        case (w134) {
          frame True {
            w135 = w7
          }
          frame False {
            Property Node(instance in=w7, "Start date:"="⛔Missing") -> (instance out=w135)
          }
        }
        $Specifications <- w135
        w3 = w126
        w4 = s2
        w5 = s3
        w8 = s6
        w9 = s7
        w10 = s8
      }
      frame "Get Events from TXT" {
        call "Get_All_Part_Txt.gviweb"(Happ_file=s2, Error input=no error) -> (Get all charge=w136, Error Output=w137)
        call "Measurements_Txt_iCombiPro.gviweb"(Get all charge=w136, Error in=w137) -> (Charge infos=w8, First charge=w138, Error out=w139)
        call "Get_Cleaning_Processes.gviweb"(Charge infos input=w8, Error in=w139) -> (Only cleaning=w140, First Process=w141, Error out=w142)
        Property Node(instance in=reference to "Please wait...", "Visible"=FALSE, error in=w142) -> (error out=w143, instance out=w144)
        Close Reference(error in=w143, reference=w144) -> (error out=w145)
        call "Display_all_programm_in_graph.gviweb"(Charge infos=w8, Error input=w145) -> (Error Output=w146, Curve=w147, Statistics=w148, Cleaning statistics=w149, Cleaning graphic=w150)
        $Curve <- w147
        w151 = "Wait For Interaction"  # State
        $"General statistics:" <- w148
        $"Cleaning statistics:" <- w149
        w152 = reference to "Press the button to display the graphic of the two selected cleaning processes"
        Concatenate Strings("Charge Nr: ", w138) -> w153
        Build Array(w153) -> w9
        Property Node(instance in=reference to "Press the button to display details:", "Text"=w9, error in=w146) -> (error out=w154, instance out=w155)
        Close Reference(error in=w154, reference=w155) -> (error out=w156)
        Concatenate Strings("Charge Nr: ", w141) -> w157
        Build Array(w157) -> w158
        Property Node(instance in=w152, "Text"=w158, error in=w156) -> (error out=w159, instance out=w160)
        Close Reference(error in=w159, reference=w160) -> (error out=w161)
        call "Data Grid - String Column - Create Background Color Style.gvi"(reference in=reference to "common_icombi_pro", column index=6, color=4294965402, error in=w161, match operator="contains", match text="aborted") -> (reference out=w162, error out=w163)
        Close Reference(error in=w163, reference=w162) -> (error out=w164)
        Property Node(instance in=reference to "Press the button to display details:", "Disabled"=FALSE, error in=w164) -> (error out=w165, instance out=w166)
        Close Reference(error in=w165, reference=w166) -> (error out=w167)
        Property Node(instance in=reference to "Sort Process name", "Disabled"=FALSE, error in=w167) -> (error out=w168, instance out=w169)
        Close Reference(error in=w168, reference=w169) -> (error out=w170)
        Property Node(instance in=reference to "Default View", "Disabled"=FALSE, error in=w170) -> (error out=w171, instance out=w172)
        Close Reference(error in=w171, reference=w172) -> (error out=w2)
        $"Cleaning graphic:" <- w150
        $"Cleaning process table" <- w140
        $common_icombi_pro_2 <- w8
        $common_icombi_pro <- w8
        w3 = w151
        w4 = s2
        w5 = s3
        w6 = s4
        w7 = s5
        w10 = s8
      }
      frame "Details of selected charge" {
        call "Get_All_Part_Txt.gviweb"(Happ_file=s2, Error input=no error) -> (Get all charge=w173, Error Output=w174)
        call "Display_Details.gviweb"(Get all charge=w173, Charge Name=s7, all in txt ?=TRUE, Error input=w174) -> (Details of the selected programme:=w175, Programme Details=w176, Curve=w177, Error Output=w2)
        $"Details of the selected programme:" <- w175
        w178 = "Wait For Interaction"  # State
        $"Programme details" <- w176
        $"Graph Display_txt" <- w177
        w3 = w178
        w4 = s2
        w5 = s3
        w6 = s4
        w7 = s5
        w8 = s6
        w9 = s7
        w10 = s8
      }
      frame "Details of multiple charges" {
        w179 = "Wait For Interaction"  # State
        call "Get_All_Part_Txt.gviweb"(Happ_file=s2, Error input=no error) -> (Get all charge=w180, Error Output=w181)
        Array Index(array=s7) -> (out0[0]=w182)
        Match Pattern(regular expression=";", string=w182) -> (after substring=w183, before substring=w184, match substring=w185)
        case (w185) {
          frame ";" {
            Build Array(w184) -> w187
            call "Display_Details.gviweb"(Get all charge=w180, Charge Name=w187, all in txt ?=TRUE, Error input=w181) -> (Curve double=w188, Error Output=w189)
            Concatenate Strings("Charge Nr:", w183) -> w190
            Build Array(w190) -> w191
            call "Display_Details.gviweb"(Get all charge=w180, Charge Name=w191, all in txt ?=TRUE, Error input=w189) -> (Curve double=w192, Error Output=w2)
            Insert Into Array(inArray=w188, new=w192) -> w186
          }
          frame "False", Default {
            call "Display_Details.gviweb"(Get all charge=w180, Charge Name=s7, all in txt ?=TRUE, Error input=w181) -> (Error Output=w2)
            w186 = default
          }
        }
        $"Graph Display multiple" <- w186
        w3 = w179
        w4 = s2
        w5 = s3
        w6 = s4
        w7 = s5
        w8 = s6
        w9 = s7
        w10 = s8
      }
      frame "Get  Event from one TXT" {
        call "Get_All_Part_Txt.gviweb"(Happ_file=s2, Error input=no error) -> (Get all charge=w193, Error Output=w194)
        call "Display_Details.gviweb"(Get all charge=w193, Charge Name=s7, all in txt ?=TRUE, Error input=w194) -> (Details of the selected programme:=w195, Programme Details=w196, Curve=w197, Error Output=w2, Average temp.=w198, max value=w199)
        $"Average temperature (C°/°F):" <- w198
        $"Max temperature (C°/°F):" <- w199
        $"Details of the programme:" <- w195
        $"Programme details_2" <- w196
        w200 = "Wait For Interaction"  # State
        $"Graph Display" <- w197
        w3 = w200
        w4 = s2
        w5 = s3
        w6 = s4
        w7 = s5
        w8 = s6
        w9 = s7
        w10 = s8
      }
      frame "Wait For Interaction" {
        Property Node(instance in=reference to "Please wait...", "Visible"=FALSE, error in=no error) -> (error out=w201, instance out=w202)
        Close Reference(error in=w201, reference=w202) -> (error out=w203)
        event {
          on "Analyse" Value changed {
            w204 = "Read XML File"  # State
            $"same programme type ?" <- FALSE
            Property Node(instance in=reference to "Average temperature (C°/°F):", "Value"=0) -> (error out=w205, instance out=w206)
            Close Reference(error in=w205, reference=w206) -> (error out=w207)
            Property Node(instance in=reference to "Max temperature (C°/°F):", "Value"=0, error in=w207) -> (error out=w208, instance out=w209)
            Close Reference(error in=w208, reference=w209) -> (error out=w210)
            Property Node(instance in=reference to "icombi pro xml", "Value"=0, error in=w210) -> (error out=w211, instance out=w212)
            Close Reference(error in=w211, reference=w212) -> (error out=w213)
            Property Node(instance in=reference to "Graph Display", "Value"=T2[] [], error in=w213) -> (error out=w214, instance out=w215)
            Close Reference(error in=w214, reference=w215) -> (error out=w216)
            Property Node(instance in=reference to "i Combi Pro txt", "Value"=0, error in=w216) -> (error out=w217, instance out=w218)
            Close Reference(error in=w217, reference=w218) -> (error out=w219)
            Property Node(instance in=reference to "Specifications:", "Value"=T5[] [], error in=w219) -> (error out=w220, instance out=w221)
            Close Reference(error in=w220, reference=w221) -> (error out=w222)
            Property Node(instance in=reference to "General statistics:", "Value"=cluster{"Process": string, "quantity": string}[] [], error in=w222) -> (error out=w223, instance out=w224)
            Property Node(instance in=reference to "Specifications", "Value"=T3 {all zero or empty}, error in=w223) -> (error out=w225, instance out=w226)
            Close Reference(error in=w225, reference=w226) -> (error out=w227)
            Property Node(instance in=reference to "Graph Display", "Value"=T2[] [], error in=w227) -> (error out=w228, instance out=w229)
            Close Reference(error in=w228, reference=w229) -> (error out=w230)
            Property Node(instance in=reference to "common", "Value"=T1[] [], error in=w230) -> (error out=w231, instance out=w232)
            Close Reference(error in=w231, reference=w232) -> (error out=w233)
            Property Node(instance in=reference to "Details of the programme:", "Value"=cluster{"Information": string, "Detail": string}[] [], error in=w233) -> (error out=w234, instance out=w235)
            Close Reference(error in=w234, reference=w235) -> (error out=w236)
            Property Node(instance in=reference to "Programme details_2", "Value"=T1[] [], error in=w236) -> (error out=w237, instance out=w238)
            Close Reference(error in=w237, reference=w238) -> (error out=w239)
            Close Reference(error in=w239, reference=w224) -> (error out=w240)
            Property Node(instance in=reference to "common_icombi_pro", "Value"=T4[] [], error in=w240) -> (error out=w241, instance out=w242)
            Close Reference(error in=w241, reference=w242) -> (error out=w243)
            Property Node(instance in=reference to "Cleaning graphic:", "Value"=cluster{"Element 1": f64[], "Element 2": f64[]}[] [], error in=w243) -> (error out=w244, instance out=w245)
            Close Reference(error in=w244, reference=w245) -> (error out=w246)
            Property Node(instance in=reference to "Details of the selected programme:", "Value"=cluster{"Information": string, "Detail": string}[] [], error in=w246) -> (error out=w247, instance out=w248)
            Close Reference(error in=w247, reference=w248) -> (error out=w249)
            Property Node(instance in=reference to "Programme details", "Value"=T1[] [], error in=w249) -> (error out=w250, instance out=w251)
            Close Reference(error in=w250, reference=w251) -> (error out=w252)
            Property Node(instance in=reference to "Curve", "Value"=T2[] [], error in=w252) -> (error out=w253, instance out=w254)
            Close Reference(error in=w253, reference=w254) -> (error out=w255)
            Property Node(instance in=reference to "Graph Display_txt", "Value"=T2[] [], error in=w255) -> (error out=w256, instance out=w257)
            Close Reference(error in=w256, reference=w257) -> (error out=w258)
            Property Node(instance in=reference to "Press the button to display details:", "Disabled"=TRUE, "Text"=["No charge is selected"], error in=w258) -> (error out=w259, instance out=w260)
            Close Reference(error in=w259, reference=w260) -> (error out=w261)
            Property Node(instance in=reference to "Sort Process name", "Disabled"=TRUE, "Value"=FALSE, "Text"=["Sort Process name"], error in=w261) -> (error out=w262, instance out=w263)
            Close Reference(error in=w262, reference=w263) -> (error out=w264)
            Property Node(instance in=reference to "Default View", "Disabled"=TRUE, "Value"=TRUE, error in=w264) -> (error out=w265, instance out=w266)
            Close Reference(error in=w265, reference=w266) -> (error out=w267)
            Property Node(instance in=reference to "Graph Display multiple", "Value"=cluster{"Element 1": f64[], "Element 2": f64[]}[] [], error in=w267) -> (error out=w268, instance out=w269)
            Close Reference(error in=w268, reference=w269) -> (error out=w2)
            Property Node(instance in=reference to "Please wait...", "Visible"=TRUE, error in=w203) -> (error out=w270, instance out=w271)
            Close Reference(error in=w270, reference=w271) -> (error out=w272)
            Property Node(instance in=reference to "Cleaning statistics:", "Value"=T6[] [], error in=w272) -> (error out=w273, instance out=w274)
            Close Reference(error in=w273, reference=w274)
            w3 = w204
            w9 = s7
          }
          on "Sort Process name" Value changed {
            w275 = "Wait For Interaction"  # State
            Event Data() -> ("Old Value"=w276, "New Value"=w277)
            Not(x=w276) -> w278
            case (w277) {
              frame False, Default {
                Property Node(instance in=reference to "Sort Process name", "Text"=["Sort Process name ▼ "], error in=w203) -> (error out=w279, instance out=w280)
              }
              frame True {
                Property Node(instance in=reference to "Sort Process name", "Text"=["Sort Process name ▲"], error in=w203) -> (error out=w279, instance out=w280)
              }
            }
            Close Reference(error in=w279, reference=w280) -> (error out=w281)
            Property Node(instance in=reference to "Default View", "Value"=FALSE, error in=w281) -> (error out=w282)
            call "Sort_table.gviweb"(Sort Process name=w278, Imput infos=$common_icombi_pro, Error Cluster input=w282) -> (Output infos=w283, Error Output=w2)
            $common_icombi_pro <- w283
            w3 = w275
            w9 = s7
          }
          on "Default View" Value changed {
            w284 = "Wait For Interaction"  # State
            case ($"Default View") {
              frame False, Default {
                w2 = w203
              }
              frame True {
                $common_icombi_pro <- $common_icombi_pro_2
                Property Node(instance in=reference to "Sort Process name", "Text"=["Sort Process name"], "Value"=FALSE, error in=w203) -> (error out=w285, instance out=w286)
                Close Reference(error in=w285, reference=w286) -> (error out=w2)
              }
            }
            w3 = w284
            w9 = s7
          }
          on "common_icombi_pro" Value changed {
            w287 = "Wait For Interaction"  # State
            Event Data() -> ("Old Value"=w288, "New Value"=w289)
            for {
              w290 = each element of w288
              w291 = each element of w289
              Property Node(instance in=w290) -> ("Selected"=w293)
              case (w293) {
                frame False, Default {
                  Property Node(instance in=w291) -> ("Selected"=w294, "Charge Nr."=w295)
                  case (w294) {
                    frame False, Default {
                      w9 = s7
                    }
                    frame True {
                      Concatenate Strings("Charge Nr: ", w295) -> w296
                      Build Array(w296) -> w9
                      Property Node(instance in=reference to "Press the button to display details:", "Text"=w9) -> (error out=w297, instance out=w298)
                      Close Reference(error in=w297, reference=w298)
                    }
                  }
                }
                frame True {
                  Not(x=w293) -> w294
                  w9 = s7
                }
              }
              Property Node(instance in=w291, "Selected"=w294) -> (instance out=w299)
              append w299 to w292
            }
            $common_icombi_pro <- w292
            w2 = w203
            w3 = w287
          }
          on "Cleaning process table" Value changed {
            w300 = "Wait For Interaction"  # State
            Event Data() -> ("Old Value"=w301, "New Value"=w302)
            call "Select_more_than_Cleaning_process.gviweb"(Cleaning process old=w301, Cleaning process new=w302, Error input=w203) -> (Two selected charge=w303, Selected Charge Nr.=w304, same reciepe name=w305, Error Output=w306)
            $"same programme type ?" <- w305
            w307 = reference to "Press the button to display the graphic of the two selected cleaning processes"
            Concatenate Strings("Charge Nr: ", w304) -> w308
            Build Array(w308) -> w309
            Property Node(instance in=w307, "Text"=w309, error in=w306) -> (error out=w310, instance out=w311)
            Close Reference(error in=w310, reference=w311) -> (error out=w2)
            $"Cleaning process table" <- w303
            w3 = w300
            w9 = s7
          }
          on "Press the button to display details:" Value changed {
            Property Node(instance in=reference to "Press the button to display details:", error in=w203) -> ("Text"=w9, error out=w312)
            for {
              w313 = each element of w9
              case (w313) {
                frame "No charge is selected" {
                  w314 = "Please select a programme after opening a haccp file \nand click the button again to display the details!"
                  One Button Dialog(message=w314)
                  w2 = w312
                }
                frame "False", Default {
                  Property Node(instance in=reference to "i Combi Pro txt", "Value"=2, error in=w312) -> (error out=w315, instance out=w316)
                  Close Reference(error in=w315, reference=w316) -> (error out=w2)
                }
              }
            }
            w317 = "Details of selected charge"  # State
            w3 = w317
          }
          on "Press the button to display the graphic of the two selected cleaning processes" Value changed {
            w318 = "Details of multiple charges"  # State
            w319 = reference to "Press the button to display the graphic of the two selected cleaning processes"
            Property Node(instance in=w319, error in=w203) -> ("Text"=w9, error out=w320)
            case ($"same programme type ?") {
              frame False {
                w321 = "Please select two cleaning programmes of the same type and click on the button again to display the details!"
                One Button Dialog(message=w321)
                w2 = w320
              }
              frame True {
                Property Node(instance in=reference to "i Combi Pro txt", "Value"=5, error in=w320) -> (error out=w322, instance out=w323)
                Close Reference(error in=w322, reference=w323) -> (error out=w2)
              }
            }
            w3 = w318
          }
        }
        w4 = s2
        w5 = s3
        w6 = s4
        w7 = s5
        w8 = s6
        w10 = s8
      }
    }
    next s1 = w3
    next s2 = w4
    next s3 = w5
    next s4 = w6
    next s5 = w7
    next s6 = w8
    next s7 = w9
    next s8 = w10
    stop if FALSE
  }
